# Grasshopper definition GIPPO_1.0.0.gh (Grasshopper 1.0.8)

# ----
# First Layer Angle
first_layer_angle = Slider(0, range=0..360)

# ----
# Handles for
# mechanical testing
# In case of unrecognized cluster:
# - Right click on the cluster
# - Update
# - Open the *.ghcluster file with the name
# reported on top of the cluster
handles = ValueList({"No": 0, "Yes": 1}, selected="Yes")

# ----
# Meander
# only for lines
meander = ValueList({"Yes": 1, "No": 2}, selected="Yes")

# ----
# Printing Surface
# to project
plane_surface = PlaneSurface(Plane=PlaneXY(0, 0, 0), XSize=Domain(-30, 30), YSize=Domain(-30, 30))

# ----
# Strand Distance
panel = Panel("0.6")

# ----
# Number of Layers
panel_2 = Panel("2")

# ----
# Angle of rotation
panel_3 = Panel("0")

# ----
# Type of Infill
type_of_infill = ValueList({"Lines": 1, "Sine": 2, "Triangles": 3, "Voronoi": 4, "Honeycomb": 5, "Auxetic: Arrowheads": 6, "Auxetic: Re-entrant Honeycomb": 7, "Snub square": 8, "2-Uniform Tiling D": 9, "Rhombitrihexagonal": 10, "2-Uniform Tiling C": 11, "Penrose": 12}, selected="Honeycomb")

# ----
# Number of points
number_of_points = Slider(200, range=0..500)

# ----
# Layer Thickness
panel_4 = Panel("0.148")

# ----
# Contours
contours = ValueList({"No": 0, "Yes": 1}, selected="No")

# ----
# Nozzle Diameter
value_list = ValueList({"0.4", "0.3", "0.25", "0.2", "0.1"}, selected="0.25")

# ----
# Building angle
panel_5 = Panel("0")

# ----
# Tiles
tiling_size = Slider(1, range=0..10)

# ----
# Voronoi
points_density_pt_mm_2 = Slider(0.5, range=0..10)

# ----
# Sine
angular_frequency = Slider(2, range=0..10)
amplitude = Slider(1, range=0..10)

# ----
# Arrowhead
h1 = Slider(2.372, range=0..5)
h2 = Slider(0.633, range=0..5)
_2l = Slider(1.904, range=0..5)
image_sampler = ImageSampler(
    FilePath="C:\Documents\Work\MERLN\RESEARCH\01. Projects\09. PF_09 - Slicer\01. Experiments\PF_09_017 - GIPPO_1.0\Figures\AH.png",
    Filter="Colour",
    Interpolate=False,
    Umax=1,
    Umin=0,
    Vmax=1,
    Vmin=0,
    Wrap=1)

# ----
# Re-Entrant Honeycomb
l0 = Slider(1.786, range=0..5)
l1 = Slider(0.544, range=0..5)
h0 = Slider(2.5, range=0..5)
image_sampler_2 = ImageSampler(
    FilePath="C:\Documents\Work\MERLN\RESEARCH\01. Projects\09. PF_09 - Slicer\01. Experiments\PF_09_017 - GIPPO_1.0\Figures\RE-HC.png",
    Filter="Colour",
    Interpolate=False,
    Umax=1,
    Umin=0,
    Vmax=1,
    Vmin=0,
    Wrap=1)

# ----
# Honeycomb
size_of_hexagonal_cell_radius = Slider(1.5, range=0..10)

# ----
# Triangle
triangle_period = Slider(2, range=0..10)
triangle_amplitude = Slider(1, range=0..10)

# ----
# 3. Export the graphs
# Only select a folder to save
# the files into
save_files = BooleanToggle(False)

# ----
# 4. Reimport the
# optimized trajectories
# Select the first one
# of the exported files from MATLAB
reimport_paths = BooleanToggle(False)

# ----
# 2. Set Pores parameters
weave = Weave(
    Pattern=[0, 1, 2, 3, 4, 5, 6, 7, 8, 9, 10, 11, 12],
    Stream0=amplitude,
    Stream1=angular_frequency,
    Stream2=triangle_amplitude,
    Stream3=triangle_period,
    Stream4=size_of_hexagonal_cell_radius,
    Stream5=points_density_pt_mm_2,
    Stream6=tiling_size,
    Stream7=_2l,
    Stream8=h1,
    Stream9=h2,
    Stream10=h0,
    Stream11=l0,
    Stream12=l1,
    NullGaps=False)

graft_tree = GraftTree(Tree=weave, IncludeEmptyLists=True, IncludeNullItems=True)
# 6. Save the gcode
# (or nc) file
save_files_2 = BooleanToggle(False)
save_files_3 = BooleanToggle(False)

# ----
# Starting geometry
x_length = Slider(10, range=1..20)
y_length = Slider(10, range=1..20)
radius = Slider(6, range=1..20)
radius_2 = Slider(24, range=1..100)
number_of_sides = Slider(5, range=1..20)
rectangle = Rectangle(Plane=PlaneXY(0, 0, 0), XSize=x_length, YSize=y_length, Radius=0)  # -> Rectangle, Length
polygon = Polygon(Plane=PlaneXY(0, 0, 0), Radius=radius, Segments=number_of_sides, FilletRadius=0)  # -> Polygon, Length
circle_cnr = CircleCNR(Center=Point(0, 0, 0), Normal=Vector(0, 0, 1), Radius=radius_2)

# ----
# 1. Set Design and
# structural parameters
multiplication = Multiplication(A=panel_4, B=panel_2)

unit_z = UnitZ(Factor=multiplication)
extrude = Extrude(Base=rectangle.Rectangle, Direction=unit_z)

weave_2 = Weave(
    Pattern=[0, 1, 2, 3, 4, 5, 6, 7, 8, 9, 10, 11, 12],
    Stream0=extrude,
    Stream1=multiplication,
    Stream2=panel_5,
    Stream3=plane_surface,
    Stream4=panel_4,
    Stream5=first_layer_angle,
    Stream6=panel_3,
    Stream7=panel,
    Stream8=type_of_infill,
    Stream9=meander,
    Stream10=number_of_points,
    Stream11=panel_2,
    Stream12=value_list,
    NullGaps=False)

graft_tree_2 = GraftTree(Tree=weave_2, IncludeEmptyLists=True, IncludeNullItems=True)

# ----
# Beta_MACRO_Design
macro_design = MACRO_Design(input_design_parameters=graft_tree_2, pores_dimensions=graft_tree)  # -> contours_final, sliced_part

# ----
# Beta_Graph_Save_MACRO
graph_save_macro = Graph_Save_MACRO(sliced_part=macro_design.sliced_part, num_layers=panel_2, trigger=save_files)  # -> nodes, segments, starts_indeces_txt, ends_indeces_txt

# ----
# Beta_Reimport_Handles_MACRO
reimport_handles_macro = Reimport_Handles_MACRO(
    toggle=reimport_paths,
    contours=macro_design.contours_final,
    nodes=graph_save_macro.nodes,
    start_indeces=graph_save_macro.starts_indeces_txt,
    ends_indeces=graph_save_macro.ends_indeces_txt,
    segments=graph_save_macro.segments,
    handles_selector=handles,
    input_design_parameters=graft_tree_2,
    number_of_layers=panel_2,
    layer_thickness=panel_4,
    contours_selector=contours)

polyline = PolyLine(Vertices=reimport_handles_macro, Closed=False)

# ----
# Gcode Previewer
# FDM Codes generation
# Beta_FDM_Codes
# Beta_FDM_Params
# 5. Set the
# printing parameters
cluster = Cluster_3()
cluster_2 = Cluster_2(optimized_path=reimport_handles_macro, layer_thickness=panel_4, input_fdm_slicing_param=cluster)
panel_6 = Panel(cluster_2)
ghpython_script = GhPythonScript(data=cluster_2, trigger=save_files_2)  # -> out, a; inputs data: list
# ---------- ghpython_script: Python ----------
__author__ = "pierp"
__version__ = "2024.03.14"

import os
import rhinoscriptsyntax as rs

def convert_to_list(data):
    # Check if the input data is already a list
    if isinstance(data, list):
        return data
    
    # If the data is not a list, split it by lines and convert it to a list
    data_list = data.splitlines()
    return data_list

def save_list_to_gcode(data, file_path):
    if not file_path:
        print("No file path provided. Please select a file.")
        return
    
    try:
        # Write data to the file
        with open(file_path, "w") as file:
            print("Saving data:", data)
            for item in data:
                file.write("%s\n" % item)
        
        print("G-code file saved successfully.")
    
    except Exception as e:
        print("Error:", e)

def main(data, trigger):
    if trigger:
        # Convert input data to a list if necessary
        data_list = convert_to_list(data)
        
        # Prompt user to specify a file name and directory
        file_path = rs.SaveFileName("Save As", "G-code Files (*.gcode)|*.gcode||")
        
        if file_path:
            print("Selected file:", file_path)
            save_list_to_gcode(data_list, file_path)
        else:
            print("File selection canceled.")

# Call the main function with your data and trigger value
# The trigger value is controlled by a toggle button in Grasshopper
main(data, trigger)
# ---------- end ghpython_script ----------

# ----
# Beta_Input Bioscaff Param
# Bioscaffolder NC file generation
# Gcode Previewer
# Bioscaffolder
# Codes generation
beta_input_bioscaff_param = Beta_InputBioscaffParam()
beta_bioscaff_codes = Beta_Bioscaff_Codes(x=reimport_handles_macro, input_slicing_parameters=beta_input_bioscaff_param)
gcode = Panel(beta_bioscaff_codes)
ghpython_script_2 = GhPythonScript(data=beta_bioscaff_codes, trigger=save_files_3)  # -> out, a; inputs data: list
# ---------- ghpython_script_2: Python ----------
__author__ = "pierp"
__version__ = "2024.03.14"

import os
import rhinoscriptsyntax as rs

def convert_to_list(data):
    # Check if the input data is already a list
    if isinstance(data, list):
        return data
    
    # If the data is not a list, split it by lines and convert it to a list
    data_list = data.splitlines()
    return data_list

def save_list_to_gcode(data, file_path):
    if not file_path:
        print("No file path provided. Please select a file.")
        return
    
    try:
        # Write data to the file
        with open(file_path, "w") as file:
            print("Saving data:", data)
            for item in data:
                file.write("%s\n" % item)
        
        print("G-code file saved successfully.")
    
    except Exception as e:
        print("Error:", e)

def main(data, trigger):
    if trigger:
        # Convert input data to a list if necessary
        data_list = convert_to_list(data)
        
        # Prompt user to specify a file name and directory
        file_path = rs.SaveFileName("Save As", "NC Files (*.nc)|*.nc||")
        
        if file_path:
            print("Selected file:", file_path)
            save_list_to_gcode(data_list, file_path)
        else:
            print("File selection canceled.")

# Call the main function with your data and trigger value
# The trigger value is controlled by a toggle button in Grasshopper
main(data, trigger)
# ---------- end ghpython_script_2 ----------

# ==== cluster MACRO_Design
input_design_parameters = ClusterInput()
pores_dimensions = ClusterInput()  # Pores dimensions
# 0. 3D Model
# 1. Model total height
# 2. Building Angle
# 3. Printing surface
# 4. Layer Thickness
# 5. First layer angle
# 6. x=angle of rotation
# 7. Strand Distance
# 8. Type of Infill
# 9. Meander yes/no
# 10. Number of points
# 11. Number of Layers
# 12. Nozzle Diameter
explode_tree = ExplodeTree(InputDesignParameters=input_design_parameters)  # -> Branch0, Branch1, Branch2, Branch3, Branch4, Branch5, Branch6, Branch7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

# ---- group: Pores design
# Beta_Object contours formation
# Beta_Printing Surface
# Beta_Infill formation
printing_surface = PrintingSurface(
    building_angle=explode_tree.Branch2,
    model_total_height=explode_tree.Branch1,
    layer_thickness=explode_tree.Branch4,
    printing_surface=explode_tree.Branch3)  # -> oriented_printing_surface, surfaces_pattern, centroids_pattern, building_direction
object_contours_formation = ObjectContoursFormation(
    _3d_model=explode_tree.Branch0,
    model_total_height=explode_tree.Branch1,
    layer_thickness=explode_tree.Branch4,
    building_direction=printing_surface.building_direction,
    number_of_layers=explode_tree.Branch11)  # -> object_contours, simplify(contours_final)
infill_formation = InfillFormation(
    contours_total=object_contours_formation.contours_final,
    strand_distance=explode_tree.Branch7,
    first_layer_angle=explode_tree.Branch5,
    object_contours=object_contours_formation.object_contours,
    layer_thickness=explode_tree.Branch4,
    angle_of_rotation=explode_tree.Branch6,
    number_of_layers=explode_tree.Branch11,
    type_of_infill=explode_tree.Branch8,
    pores_dimensions=pores_dimensions)

# ----
# First layer lifted to
# layer height value
unit_z = UnitZ(Factor=explode_tree.Branch4)
move = Move(Geometry=infill_formation, Motion=unit_z)  # -> SlicedPart, Transform
move_2 = Move(Geometry=object_contours_formation.contours_final, Motion=unit_z)  # -> ContoursFinal, Transform

sliced_part = ClusterOutput(move.SlicedPart)
contours_final = ClusterOutput(move_2.ContoursFinal)

# ==== cluster Cluster_2
# 0. Printing Speed
# 1. Type of extrusion
# 2. Extruder Temperature
# 3. Bed Temperature
# 4. Printing bed dimensions
# 5. Type of Origin
# 6. Fan Speed
# 7. Preflow [mm]
# 8. Retraction [mm]
# 9. Retraction Speed [mm/s]
# 10. Nozzle diameter [mm]
input_fdm_slicing_param = ClusterInput()
layer_thickness = ClusterInput()  # Layer Thickness
optimized_path = ClusterInput()  # Optimized Path
bang = ExplodeTree(InputFDMSlicingParam=input_fdm_slicing_param)  # -> Branch0, Branch1, Branch2, Branch3, Branch4, Branch5, Branch6, Branch7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
deconstruct = Deconstruct(Point=bang.Branch11)  # -> XComponent, YComponent, ZComponent

# ----
# Generation of the
# M106 command
# FAN speed
ghpython_script = GhPythonScript(x=bang.Branch6)  # -> out, a
# ---------- ghpython_script: Python ----------
__author__ = "P70070779"
__version__ = "2023.07.13"

import rhinoscriptsyntax as rs

fan=int(x)*2.55
fan=int(round(fan,0))+1
a=('M106 S'+str(fan)+' ;fan speed')
# ---------- end ghpython_script ----------

# ----
# Generation of the
# M82/M83 command
ghpython_script_2 = GhPythonScript(x=bang.Branch1)  # -> out, a
# ---------- ghpython_script_2: Python ----------
__author__ = "P70070779"
__version__ = "2023.07.13"

import rhinoscriptsyntax as rs

if x==1:
    a='M82 ;Absolute extrusion mode'
else: a='M83 ;Relative extrusion mode'
# ---------- end ghpython_script_2 ----------

# ----
# Generation of the
# M109/M190 command
# 
# Bed/Extruder heating
ghpython_script_3 = GhPythonScript(x=bang.Branch2, y=bang.Branch3)  # -> out, a
# ---------- ghpython_script_3: Python ----------
__author__ = "P70070779"
__version__ = "2023.07.13"

import rhinoscriptsyntax as rs

print('M104 S'+str(int(x))+' T0 ;heat extruder')
print('M140 S'+str(int(y))+' ;heat bed')
# ---------- end ghpython_script_3 ----------

number = Number(1)
integer = Integer(1)

# ----
# F Value
panel = Panel("60")
multiplication = Multiplication(A=panel, PrintingSpeed=bang.Branch0)

division = Division(A=bang.Branch12, B="100")
division_2 = Division(A="1", B=division)
panel_2 = Panel("""0
1""")
panel_3 = Panel("""G92 E0 ; Reset Extruder

G28 ; Home all axes
G1 Z10.0 F3000 ; Move Z Axis up little to prevent scratching of Heat Bed
G1 X0 Y0

G1 X0.1 Y20 Z0.3 F5000.0 ; Move to start position
G1 X0.1 Y200.0 Z0.3 F1500.0 E15 ; Draw the first line
G1 X0.8 Y200.0 Z0.3 F5000.0 ; Move to side a little
G1 X0.8 Y20 Z0.3 F1500.0 E30 ; Draw the second line
G92 E0 ; Reset Extruder
G1 Z2.0 F3000 E-2.5; Move Z Axis up little to prevent scratching of Heat Bed
G1 X5 Y20 Z5.0 F5000.0 E-0.4; Move over to prevent blob squish
;G1 F6000 X110 Y110 Z5.0 E-1 
G1 F6000 X195 Y50 Z5.0 E-1.5
G92 E0""")
panel_4 = Panel("""G91 ;Relative positioning
G92 E0
G1 E-1 F2700 ;Retract a bit
G1 E-1 Z0.2 F2400 ;Retract and raise Z
G1 X5 Y5 E0 F3000 ;Wipe out
G1 Z10 ;Raise Z more
G90 ;Absolute positioning
G1 X0 Y0 F6000 ;Present print
M106 S0 ;Turn-off fan
;M104 S0 ;Turn-off hotend
;M140 S0 ;Turn-off bed
M84 X Y E ;Disable all steppers but Z""")

# ----
# Calculation of the origin (if necessary)
deconstruct_2 = Deconstruct(Point=optimized_path)  # -> XComponent, YComponent, ZComponent
integer_2 = Integer(bang.Branch4)
ghpython_script_4 = GhPythonScript(y=bang.Branch5, z=integer_2)  # -> out, a
# ---------- ghpython_script_4: Python ----------
__author__ = "P70070779"
__version__ = "2023.07.13"

import rhinoscriptsyntax as rs

if y==0:
    a=z/2
else:
    a=0
# ---------- end ghpython_script_4 ----------

addition = Addition(A=ghpython_script_4.a, B=deconstruct.XComponent)
addition_2 = Addition(A=ghpython_script_4.a, B=deconstruct.YComponent)

addition_3 = Addition(A=deconstruct_2.YComponent, B=addition_2)
addition_4 = Addition(A=deconstruct_2.XComponent, B=addition)
construct_point = ConstructPoint(XCoordinate=addition_4, YCoordinate=addition_3, ZCoordinate=deconstruct_2.ZComponent)  # -> simplify(Point)

# ----
# E values calculation
# 
# E=length*nozzle_diam^2/filament_diam^2
# E Values clustering
# for putting to zero every first E value of the sublist
pline = PolyLine(Vertices=optimized_path, Closed=False)
explode = Explode(Curve=pline, Recursive=True)  # -> Segments, Vertices
len = Length(Curve=explode.Segments)
ghpython_script_5 = GhPythonScript(x=len, y=bang.Branch10)  # -> out, a
# ---------- ghpython_script_5: Python ----------
__author__ = "P70070779"
__version__ = "2023.07.13"

import rhinoscriptsyntax as rs
a=1.0*((x*(y**2))/1.75**2)
# ---------- end ghpython_script_5 ----------

ghpython_script_6 = GhPythonScript(length=len, LT=layer_thickness, EM=number, nozzle=bang.Branch10)  # -> out, a
# ---------- ghpython_script_6: Python ----------
__author__ = "P70070779"
__version__ = "2023.07.13"

import rhinoscriptsyntax as rs
import math
#a=1.0*((x*(y**2))/1.75**2)
a=0.625*(4*length*LT*EM*nozzle)/(math.pi*1.75**2)
# ---------- end ghpython_script_6 ----------
panel_5 = Panel(ghpython_script_6.a)

# ----
# E Values clustering
list_length = ListLength(List=optimized_path)

subtraction = Subtraction(A=list_length, B=integer)

partition_list = PartitionList(EValues=flatten(ghpython_script_6.a), Size=flatten(subtraction))  # -> simplify(Chunks)
insert_items = InsertItems(List=partition_list, Item="0", Indices="0", Wrap=True)
ma = MassAddition(Input=flatten(insert_items))  # -> Result, PartialResults

partition_list_2 = PartitionList(EValues=ma.PartialResults, Size=flatten(list_length))  # -> simplify(Chunks)

# ----
# Speed modulation for
# short segments
tree_statistics = TreeStatistics(Tree=ma.PartialResults)  # -> Paths, Length, Count
python = GhPythonScript(x=list_length, y=list_length, z=division_2)  # -> simplify(graft(x)), simplify(a)
# ---------- python: Python ----------
__author__ = "p.fucile"
__version__ = "2023_07_12"
import rhinoscriptsyntax as rs

if x>=4:
    speed_red=1
    #preflow=float(y)*float(z)
else:
    speed_red=1/z
    #speed_red=1/3
    
    


#preflow=float(y)*float(z)

#for elem in x:
    #elem=elem+preflow
    #print elem
    

print speed_red
# ---------- end python ----------
python_3_script = Python3Script(x=tree_statistics.Length, y=multiplication)  # -> out, a
# ---------- python_3_script: Python ----------
# Assuming X is your list of lists
# Generate a list of indices from 0 to 125
indices = list(range(x))

# Print the list of indices
for i in indices:
    print(y)
# ---------- end python_3_script ----------
partition_list_3 = PartitionList(EValues=python_3_script.out, Size=flatten(list_length))  # -> simplify(Chunks)
multiplication_2 = Multiplication(A=partition_list_3, B=python.x)

split_list = SplitList(List=flatten(insert_items), Index="100")  # -> ListA, ListB
# ONLY for contour
multiplication_3 = Multiplication(A=split_list.ListA, B="2")
merge = Merge(Data1=flatten(multiplication_3), Data2=flatten(split_list.ListB))

list_item = ListItem(List=flatten(list_length), Index=panel_2, Wrap=True)
ma_2 = MassAddition(Input=flatten(list_item))  # -> Result, PartialResults
split_list_2 = SplitList(List=ma.PartialResults, Index=ma_2.Result)  # -> ListA, ListB

multiplication_4 = Multiplication(A="0.00001", B="10000")
list_item_2 = ListItem(List=flatten(split_list_2.ListB), Index=0, Wrap=True)
subtraction_2 = Subtraction(A=list_item_2, B=multiplication_4)
replace_items = ReplaceItems(List=split_list_2.ListB, Item=subtraction_2, Indices=0, Wrap=False)

panel_6 = Panel(multiplication_2)
subtraction_3 = Subtraction(A=flatten(split_list_2.ListB), B=multiplication_4)
merge_2 = Merge(Data1=flatten(split_list_2.ListA), Data2=flatten(subtraction_3))

# ----
# Pre-Flow and
# pre-loading (for first segment)
tree_statistics_2 = TreeStatistics(Tree=partition_list_2)  # -> Paths, Length, Count
python_3_script_2 = Python3Script(x=tree_statistics_2.Count)  # -> out, a
# ---------- python_3_script_2: Python ----------
# Assuming X is your list of lists
# Generate a list of indices from 0 to 125
indices = list(range(x))

# Print the list of indices
for i in indices:
    print(i)
# ---------- end python_3_script_2 ----------
python_2 = GhPythonScript(x=list_length, y=list_length, z=graft(python_3_script_2.out))  # -> simplify(x), simplify(a)
# ---------- python_2: Python ----------
__author__ = "p.fucile"
__version__ = "2023_07_12"
import rhinoscriptsyntax as rs

if x<=4:
    preflow=float(y)*float(z)
    #preflow=float(y)*float(z)
elif x>=80:
    preflow=1.5
else:
    preflow=0 
    
    


#preflow=float(y)*float(z)

#for elem in x:
    #elem=elem+preflow
    #print elem
    

print preflow
# ---------- end python_2 ----------

mass_addition = MassAddition(Input=flatten(python_2.x))  # -> Result, graft(PartialResults)

addition_5 = Addition(A=partition_list_2, B=mass_addition.PartialResults, C="-0.01")

# ----
# Adds retraction
# and G0 commands
# Starting from the
# points and E values,
# creates G1 and
# format lines
# New approach
# No preflow and no "recharge"
points_to_g01_code_converter_python = GhPythonScript(x=simplify(construct_point), y=multiplication_2, z=simplify(addition_5))  # -> out, a; inputs x: Point3d, y: list of Int32
# ---------- points_to_g01_code_converter_python: Python ----------
__author__ = "p.fucile"
__version__ = "v1_2023_07_12"

import rhinoscriptsyntax as rs
#print('G1 F'+str(y) +' X'+str(x[0])+' Y'+str(x[1])+' Z'+str(x[2])+' E'+str(z))

a = ('G1 F'+str(y[0])+' X'+str(round(x[0],3))+' Y'+str(round(x[1],3))+' Z'+str(round(x[2],3))+' E'+str(round(z,7)))
# ---------- end points_to_g01_code_converter_python ----------
multiplication_5 = Multiplication(A=panel, RetractionSpeed=bang.Branch9)
list_item_3 = ListItem(List=flatten(partition_list_2), Index=0, Wrap=True)
python_3 = GhPythonScript(x=simplify(points_to_g01_code_converter_python.a), y=list_item_3)  # -> simplify(x), simplify(a); inputs x: list
# ---------- python_3: Python ----------
__author__ = "p.fucile"
__version__ = "2023_07_12"
import rhinoscriptsyntax as rs
Gcurrent,ZE = x[0].split('Z')
Z,E=ZE.split('E')

Z_incr = float(Z) + 1
G,F,GX,GY,GZ = Gcurrent.split(' ')
firstline=('G0 ' + F + ' ' + GX + ' ' + GY + ' Z' + str(Z_incr))
Estart=y



lastcoord = len(x)
Gsecond,ZEfinal = x[lastcoord-1].split('Z')
Zfin,Efin = ZEfinal.split('E')
if float(E)==round(y,4):
    firstline2=('')
    a=-1
else:
    firstline2=('G1 F3600 E'+str(E))
    a=0

Zfinal = float(Zfin) + 1
E_retrac=float(Efin)-0.05


retrac = ('G1 F3600 E'+str(E_retrac))

Estart2=E
if a!=-1:
    x.insert(0,firstline2)
x.insert(0,firstline)


x.append(retrac)


for b in range(len(x)):
    print x[b]
# ---------- end python_3 ----------
python_4 = GhPythonScript(x=simplify(points_to_g01_code_converter_python.a), y=list_item_3, z=bang.Branch8, u=multiplication_5)  # -> simplify(x), simplify(a); inputs x: list
# ---------- python_4: Python ----------
__author__ = "p.fucile"
__version__ = "2023_07_12"
import rhinoscriptsyntax as rs
Gcurrent,ZE = x[0].split('Z')
Z,E=ZE.split('E')

Z_incr = float(Z) + 3
Z_incr2=float(Z)+0.2
G,F,GX,GY,GZ = Gcurrent.split(' ')

#ffirstline=('G0 F' + str(u) + ' Z' + str(Z_incr2))
#firstline=('G0 ' + F + ' ' + GX + ' ' + GY + ' Z' + str(Z_incr))
firstline=('G0 F6000' + ' ' + GX + ' ' + GY + ' Z' + str(Z_incr))
ffirstline=('G0 F2500 ' + GX + ' ' + GY + ' Z' + str(Z_incr2))
Estart=y

firstlineE=float(E)-0.02

lastcoord = len(x)
Gsecond,ZEfinal = x[lastcoord-1].split('Z')
Zfin,Efin = ZEfinal.split('E')
if float(E)==round(y,4):
    firstline2=('')
    a=-1
else:
#    firstline2=('G1 F3600 E'+str(firstlineE))
    firstline2=('')
    a=0

Zfinal = float(Zfin) + 3
E_retrac=float(Efin)-float(z)

pause=('G4 P200')
retrac = ('G1 F'+str(u)+' E'+str(E_retrac))

Estart2=E
#if a!=-1:
#    x.insert(0,firstline2)
x.insert(0,ffirstline)
#x.insert(0,firstline)

#x.append(pause)
x.append(retrac)


for b in range(len(x)):
    print x[b]
# ---------- end python_4 ----------

python_5 = GhPythonScript(x=simplify(points_to_g01_code_converter_python.a), y=list_item_3, z=bang.Branch8, u=multiplication_5)  # -> simplify(x), simplify(a); inputs x: list
# ---------- python_5: Python ----------
__author__ = "p.fucile"
__version__ = "2023_07_12"
import rhinoscriptsyntax as rs
Gcurrent,ZE = x[0].split('Z')
Z,E=ZE.split('E')

Z_incr = float(Z) + 3
Z_incr2=float(Z)+0.2
G,F,GX,GY,GZ = Gcurrent.split(' ')

#ffirstline=('G0 F' + str(u) + ' Z' + str(Z_incr2))
#firstline=('G0 ' + F + ' ' + GX + ' ' + GY + ' Z' + str(Z_incr))
firstline=('G0 F6000' + ' ' + GX + ' ' + GY + ' Z' + str(Z_incr))
ffirstline=('G0 F2000 ' + GX + ' ' + GY + ' Z' + str(Z_incr2))
Estart=y

firstlineE=float(E)-0.02

lastcoord = len(x)
Gsecond,ZEfinal = x[lastcoord-1].split('Z')
Zfin,Efin = ZEfinal.split('E')
if float(E)==round(y,4):
    firstline2=('')
    a=-1
else:
#    firstline2=('G1 F3600 E'+str(firstlineE))
    firstline2=('')
    a=0

Zfinal = float(Zfin) + 3
E_retrac=float(Efin)-float(z)


retrac = ('G1 F'+str(u)+ ' '+GX+' '+GY+' Z'+str(Z_incr)+ ' E'+str(E_retrac))

Estart2=E
#if a!=-1:
#    x.insert(0,firstline2)
x.insert(0,ffirstline)
#x.insert(0,firstline)


x.append(retrac)


for b in range(len(x)):
    print x[b]
# ---------- end python_5 ----------
panel_7 = Panel(python_4.x)
# D1 - Bed/Extruder Heating
# D2 - Relative/Absolute extrusion
# D3 - Fan Speed
# D4 - Gcode
merge_3 = Merge(Data1=flatten(python_4.x))
merge_4 = Merge(
    Data1="; Ender 3 Custom Start G-code",
    Data2=flatten(ghpython_script_3.out),
    Data3=flatten(panel_3),
    Data4=flatten(ghpython_script_2.a),
    Data5=flatten(ghpython_script.a),
    Data6=flatten(python_4.x),
    Data7=flatten(panel_4))
gcode = ClusterOutput(merge_4)

# ==== cluster Cluster_3

# ----
# Preflow [mm]
# Retraction [mm]
# Retraction Speed [mm/s]
retraction_speed = Slider(20, range=0..500)
retraction = Slider(0.4, range=0..100)
pre_flow = Slider(1.8e-05, range=0..10)

# ----
# Fan speed
fan_speed = Slider(50, range=0..100)

# ----
# Printing bed dimensions
bed_x_dim = Slider(220, range=0..300)
bed_y_dim = Slider(220, range=0..300)

# ----
# Type of Extrusion
type_of_extrusion = ValueList({"Absolute extrusion": 1, "Relative extrusion": 2}, selected="Absolute extrusion")

# ----
# Printing speed [mm/s]
printing_speed = Slider(3.5, range=0..300)

# ----
# Nozzle Diameter
value_list = ValueList({"0.4", "0.3", "0.25", "0.2", "0.1"}, selected="0.2")

# ----
# Printing positioning
md_slider = MDSlider(
    SliderMode=0,
    slider_value=Point(0.4820652008, 0.5045730165, 0.5),
    x_domain=Domain(-110, 110),
    y_domain=Domain(-110, 110),
    z_domain=Domain(0, 1))

# ----
# Temperatures
# Extruder Temperature
# Bed Temperature
bed_temperature = Slider(50, range=0..120)
extruder_temperature = Slider(220, range=0..300)

# ----
# Type of origin
origin = ValueList({"Center of the bed": 0, "Bottom left corner": 1}, selected="Center of the bed")

# ----
# Slowdown during short segments [%]
# 100% --> nominal speed
# 1%     --> minimum speed
number_slider = Slider(60, range=1..100)

weave = Weave(
    Pattern=[0, 1, 2, 3, 4, 5, 6, 7, 8, 9, 10, 11, 12],
    Stream0=printing_speed,
    Stream1=type_of_extrusion,
    Stream2=extruder_temperature,
    Stream3=bed_temperature,
    Stream4=bed_x_dim,
    Stream5=origin,
    Stream6=fan_speed,
    Stream7=pre_flow,
    Stream8=retraction,
    Stream9=retraction_speed,
    Stream10=value_list,
    Stream11=md_slider,
    Stream12=number_slider,
    NullGaps=False)
graft = GraftTree(Tree=weave, IncludeEmptyLists=True, IncludeNullItems=True)
input_fdm_slicing_param = ClusterOutput(graft)

# ==== cluster Graph_Save_MACRO
sliced_part = ClusterInput()  # Sliced Part
# Beta_Graph Generator
graph_generator = GraphGenerator(geometry=sliced_part)  # -> global_nodes, nodes_3, segments, starts_indeces_txt, ends_indeces_txt, start, end
list_length = ListLength(List=sliced_part)  # -> flatten(Length)
num_layers = ClusterInput()
trigger = ClusterInput()
python_3_script = Python3Script(
    list1=graph_generator.starts_indeces_txt,
    list2=graph_generator.ends_indeces_txt,
    list3=graph_generator.start,
    list4=graph_generator.end,
    group_sizes=list_length,
    num_layers=num_layers,
    trigger=trigger)  # -> out, a; inputs list1: list, list2: list, list3: list of Point3d, list4: list of Point3d, group_sizes: list of Int32
# ---------- python_3_script: Python ----------
import os
import rhinoscriptsyntax as rs

def select_folder():
    """Prompt user to select a folder."""
    folder_path = rs.BrowseForFolder("Select a folder to save the files")
    if folder_path:
        print("Selected folder:", folder_path)
        return folder_path
    else:
        print("Folder selection canceled.")
        return None

def split_list(input_list, group_sizes):
    """
    Split a list into sublists based on exact group sizes.
    
    Args:
        input_list (list): The list to split.
        group_sizes (list): List of integers representing the size of each group.
        
    Returns:
        list of lists: Sublists corresponding to the group sizes.
    
    Raises:
        ValueError: If the sum of group_sizes does not equal the length of the list.
    """
    total_size = sum(group_sizes)
    if total_size != len(input_list):
        raise ValueError(f"The total of group sizes {total_size} does not match the length of the list {len(input_list)}.")

    sublists = []
    start_index = 0
    for size in group_sizes:
        end_index = start_index + size
        sublists.append(input_list[start_index:end_index])
        start_index = end_index
    return sublists

def save_num_layers(num_layers, directory):
    num_layers_name="num_layers.txt"

    num_layers_path= os.path.join(directory,num_layers_name)

    with open(num_layers_path,"w") as layers_file:
        print("Saving num_layers:",num_layers)
        layers_file.write(f"{num_layers}\n")
        
        print("Layers saved successfully.")

                

def save_sublists_to_files(input_list, group_sizes, directory, base_filename):
    """
    Save sublists to separate files with specified base filenames.
    
    Args:
        input_list (list): The list to save.
        group_sizes (list): Group sizes to split the list into.
        directory (str): Directory to save the files.
        base_filename (str): Base filename for the output files (no .txt extension).
    """
    try:
        sublists = split_list(input_list, group_sizes)
    except ValueError as e:
        print(f"Error: {e}")
        return
    
    # Iterate through sublists and save each one with the appropriate filename
    for i, sublist in enumerate(sublists):
        file_name = f"{base_filename}_{i+1}.txt"  # Create filename with _1, _2, _3 suffixes
        file_path = os.path.join(directory, file_name)
        
        try:
            with open(file_path, "w") as file:
                print(f"Saving {file_name}: {sublist}")
                for item in sublist:
                    file.write("%s\n" % item)
        except Exception as e:
            print(f"Error saving {file_name}: {e}")

def main(list1, list2, list3, list4, group_sizes, num_layers, trigger):
    """
    Main function to split and save multiple lists when the trigger is activated.
    
    Args:
        list1, list2, list3, list4 (list): The input lists to split and save.
        group_sizes (list): List of group sizes for splitting.
        trigger (bool): External trigger to execute the process.
    """
    base_filenames = [
        "Starts_Indeces",   # Base filename for list1
        "Ends_Indeces",     # Base filename for list2
        "Starts_Indeces_cart",  # Base filename for list3
        "Ends_Indeces_cart"    # Base filename for list4
    ]
    
    if trigger:
        # Select the folder once for all files
        directory = select_folder()
        if directory:
            save_num_layers(num_layers, directory)
            # Ensure the sum of group_sizes matches the list length exactly
            lists = [list1, list2, list3, list4]
            for i, input_list in enumerate(lists):
                if sum(group_sizes) != len(input_list):
                    print(f"Error: Group sizes {group_sizes} do not match the length of list {i+1}.")
                    return
                # Save each list with corresponding filenames in the same folder
                save_sublists_to_files(input_list, group_sizes, directory, base_filenames[i])


# Call the main function
main(list1, list2, list3, list4, group_sizes, num_layers, trigger)
# ---------- end python_3_script ----------
nodes = ClusterOutput(graph_generator.nodes_3)
segments = ClusterOutput(graph_generator.segments)
starts_indeces_txt = ClusterOutput(graph_generator.starts_indeces_txt)
ends_indeces_txt = ClusterOutput(graph_generator.ends_indeces_txt)

# ==== cluster Reimport_Handles_MACRO
contours = ClusterInput()  # Contours
toggle = ClusterInput()
handles_selector = ClusterInput()  # Handles selector
nodes = ClusterInput()
start_indeces = ClusterInput()
ends_indeces = ClusterInput()
segments = ClusterInput()
contours_selector = ClusterInput()  # Contours selector
input_design_parameters = ClusterInput()
number_of_layers = ClusterInput()
layer_thickness = ClusterInput()
# Beta_Reimport2
cluster = Cluster_4(
    toggle=toggle,
    nodes=nodes,
    input_design_parameters=input_design_parameters,
    start_indeces=start_indeces,
    ends_indeces=ends_indeces,
    segments=segments)  # -> i, segments_out
# Beta_ContourCreation
beta_contourcreation = Beta_ContourCreation(contours=contours, optimized_path=cluster.i, layer_thickness=layer_thickness, number_of_layers=number_of_layers)
stream_filter = StreamFilter(Gate=contours_selector, Stream0=cluster.i, Stream1=beta_contourcreation)
# Beta_Handles_v2
handles_v2 = Handles_v2(
    optimized_path=stream_filter,
    input_design_parameters=input_design_parameters,
    number_of_layers=number_of_layers,
    layer_thickness=layer_thickness)
stream_filter_2 = StreamFilter(Gate=handles_selector, Stream0=stream_filter, Stream1=handles_v2)
optimized_scaffold = ClusterOutput(stream_filter_2)  # Optimized scaffold

# ==== cluster Beta_InputBioscaffParam

# ----
# 8. E13=Post-flow [s]
e13 = Slider(0, range=0..1000)

# ----
# 7. E9=Pre-flow [s]
pre_flow = Slider(900, range=0..1000)

# ----
# 5. E8=Pullback rotation [R/s]
# Screw retraction
e8 = Slider(140, range=0..1000)

# ----
# 6. E4=Pullback time [s]
e4 = Slider(80, range=0..1000)

# ----
# 4. E3=Screwspeed [rpm]
# E3=(rpm*100)/Vol_disp --> (R/s / mm/dot)
# e.g. E3=2000 --> 20 rpm
screwspeed = Slider(2500, range=1..10000)

# ----
# 9. Filename
panel = Panel("Test")

# ----
# 3. E6=Pressure [kPa]
pressure_in_kpa = Slider(500, range=0..1000)

# ----
# 0. F = XY Speed [mm/min]
F = Slider(100, range=1..1200)

# ----
# 2. Write/Unwrite file
list = ValueList({"Write": True, "Unwrite": False}, selected="Write")

# ----
# 1. Directory to save the file
file_path = FilePath("D:\Qsync\Documenti\Work\MERLN\RESEARCH\01. Projects\09. PF_09 - Slicer\01. Experiments\PF_09_002 - Universal approach\Gcode\Bioscaff\")

panel_2 = Panel(file_path)
weave = Weave(
    Pattern=[0, 1, 2, 3, 4, 5, 6, 7, 8, 9],
    Stream0=F,
    Stream1=file_path,
    Stream2=list,
    Stream3=pressure_in_kpa,
    Stream4=screwspeed,
    Stream5=e8,
    Stream6=e4,
    Stream7=pre_flow,
    Stream8=e13,
    Stream9=panel,
    NullGaps=False)
graft_tree = GraftTree(Tree=weave, IncludeEmptyLists=True, IncludeNullItems=True)

input_slicing_parameters = ClusterOutput(graft_tree)

# ==== cluster Beta_Bioscaff_Codes
input_slicing_parameters = ClusterInput()
x = ClusterInput()
points_to_g01_code_converter_python = GhPythonScript(x=simplify(x))  # -> out, a; inputs x: Point3d
# ---------- points_to_g01_code_converter_python: Python ----------
__author__ = "k.vankampen"
__version__ = "2018.09.05"

import rhinoscriptsyntax as rs

print('G01 X'+str(x[0])+' Y'+str(x[1])+' Z'+str(x[2]))
a = ('G01 X'+str(round(x[0],3))+' Y'+str(round(x[1],3))+' Z'+str(round(x[2],3)))
# ---------- end points_to_g01_code_converter_python ----------

# ----
# 0. F = XY Speed
# 1. Directory (xx)
# 2. Write/Unwrite
# 3. E6 = Pressure
# 4. E3 = Screwspeed [rpm]
# 5. E8 = Pullback rotation
# 6. E4 = Pullback time
# 7. E9 = Pre-flow
# 8. E13 = Post-flow
# 9. Filename
explode_tree = ExplodeTree(InputSlicingParameters=input_slicing_parameters)  # -> Branch0, Branch1, Branch2, Branch3, Branch4, Branch5, Branch6, Branch7, Branch8, Branch9

panel = Panel(points_to_g01_code_converter_python.a)
python = GhPythonScript(x=simplify(points_to_g01_code_converter_python.a))  # -> simplify(x), simplify(a); inputs x: list
# ---------- python: Python ----------
__author__ = "p.fucile"
__version__ = "2023_07_11"
import rhinoscriptsyntax as rs
Gcurrent,Z = x[0].split('Z')
Z = float(Z) + 1
Zincrease = str(Gcurrent) + 'Z' + str(Z)
lastcoord = len(x)
Gsecond,Zfinal = x[lastcoord-1].split('Z')
Zfinal = float(Zfinal) + 1
Zfinalincrease = str(Gsecond) + 'Z' + str(Zfinal)
G, GX, GY, GZ = Gcurrent.split(' ')
ZGstart = ('G00 ' + GX + ' ' + GY + ' ' + 'Z' + str(Z))


x.insert(0,'E1 1')
x.insert(0,'E2 1')
x.insert(0,ZGstart)
x.insert(1,x[3])
x.append('E1 0')
x.append('E2 0')
x.append(Zfinalincrease)

for b in range(len(x)):
    print x[b]
a = [x[1], x[(b-3)]]
# ---------- end python ----------
panel_2 = Panel(python.x)
g_code_writer = GhPythonScript(
    x=flatten(python.x),
    XYspeed=explode_tree.Branch0,
    xx=explode_tree.Branch1,
    write=explode_tree.Branch2,
    Pressure=explode_tree.Branch3,
    Screwspeed=explode_tree.Branch4,
    E8=explode_tree.Branch5,
    E4=explode_tree.Branch6,
    E9=explode_tree.Branch7,
    E13=explode_tree.Branch8,
    filename=explode_tree.Branch9)  # -> Gcode; inputs x: list
# ---------- g_code_writer: Python ----------
"""Provides a scripting component.
    Inputs:
        x: The x script variable
        y: The y script variable
        xx: The xx script variable
        write: The write script variable
        filename: The filename script variable
    Output:
        a: The a output variable"""

__author__ = "k.vankampen"
__version__ = "2018.09.05"

import rhinoscriptsyntax as rs
import math
import os.path
file = os.path.join(xx, filename+".NC")
# fileopen = open(file,"w")

print ('(' + filename + ')')
print ('G54')
print ('E21 0')
print ('E7 0')
print ('E111 9500')
print ('(Dispensing)')
print ('E22 0')
print ('T11 M06')
print ('E7 0')
print ('E0 9500')
print ('G00 Z50')
print ('G00 X0 Y0')
print ('E6 ' + str(int(Pressure)))
print ('F'+XYspeed)
print ('G00')
print ('E3 '+str(int(Screwspeed)))
print ('E8 '+str(int(E8)))
print ('E4 '+str(int(E4)))
print ('E9 '+str(int(E9)))
print ('E13 ' + str(int(E13)))

#
for b in range(len(x)):
    Gcode = x[b]
    print Gcode
print ('F'+XYspeed)
print ('G01 Z30')
print ('M30')

#
# ---------- end g_code_writer ----------
gcode = ClusterOutput(g_code_writer)

# ==== cluster PrintingSurface
printing_surface = ClusterInput()
model_total_height = ClusterInput()
building_angle = ClusterInput()
layer_thickness = ClusterInput()
unit_z = UnitZ(Factor=layer_thickness)
radians = Radians(BuildingAngle=building_angle)
unit_y = UnitY(Factor=1)
xy_plane = XYPlane(Origin=Point(0, 0, 0))
volume = Volume(PrintingSurface=printing_surface)  # -> Volume, Centroid
division = Division(ModelTotalHeight=model_total_height, LayerThickness=layer_thickness)
rotate = Rotate(DirectionOfSlicing=unit_z, Axis=unit_y, Angle=radians)
project_point = ProjectPoint(Point=volume.Centroid, DirectionOfSlicing=unit_z, PrintingSurface=printing_surface)  # -> Point, Index
adjust_plane = AdjustPlane(Plane=xy_plane, Normal=rotate)
linear_array = LinearArray(Centroids=project_point.Point, DirectionOfSlicing=rotate, Count=division)  # -> CentroidsPattern, Transform
linear_array_2 = LinearArray(PrintingSurface=printing_surface, DirectionOfSlicing=rotate, Count=division)  # -> SurfacesPattern, Transform
oriented_printing_surface = ClusterOutput(adjust_plane)
surfaces_pattern = ClusterOutput(linear_array_2.SurfacesPattern)
centroids_pattern = ClusterOutput(linear_array.CentroidsPattern)
building_direction = ClusterOutput(rotate)

# ==== cluster ObjectContoursFormation
model_total_height = ClusterInput()
layer_thickness = ClusterInput()
building_direction = ClusterInput()
number_of_layers = ClusterInput()
_3d_model = ClusterInput()
division = Division(ModelTotalHeight=model_total_height, LayerThickness=layer_thickness)
xy_plane = XYPlane(Origin=Point(0, 0, 0))
linear_array = LinearArray(PrintingPlane=xy_plane, BuildingDirection=building_direction, NumberOfLayers=number_of_layers)  # -> Geometry, Transform
# ALWAYS REMEMBER
# First contour (for z=0 must be removed)
brep_plane = BrepPlane(_3DModel=_3d_model, Plane=linear_array.Geometry)  # -> ObjectContours, Points
list_item = ListItem(List=flatten(brep_plane.ObjectContours), Index=0, Wrap=True)
contours_final = ClusterOutput(brep_plane.ObjectContours)  # Contours final
object_contours = ClusterOutput(list_item)  # Object Contours

# ==== cluster InfillFormation
pores_dimensions = ClusterInput()  # Pores dimensions
strand_distance = ClusterInput()
first_layer_angle = ClusterInput()
number_of_layers = ClusterInput()
object_contours = ClusterInput()
angle_of_rotation = ClusterInput()  # Angle of rotation
contours_total = ClusterInput()  # Contours Total
layer_thickness = ClusterInput()

# ----
# Flags for
# infill type/meander
type_of_infill = ClusterInput()  # Type of Infill
python_3_script = Python3Script(x=type_of_infill)  # -> out, a, b
# ---------- python_3_script: Python ----------
import rhinoscriptsyntax as rs

if x==1:
    a=0
    b=0
#if x==1 and y==1:
#    a=0
#    b=1
#elif x==1 and y==2:
#    a=0
#    b=0
elif x==2:
    a=1
    b=0
elif x==3:
    a=2
    b=0
elif x==4:
    a=3
    b=2
elif x==5:
    a=4
    b=2
elif x==6:
    a=5
    b=2
elif x==7:
    a=6
    b=2
elif x==8:
    a=7
    b=2
elif x==9:
    a=8
    b=2
elif x==10:
    a=9
    b=2
elif x==11:
    a=10
    b=2
elif x==12:
    a=11
    b=2
# ---------- end python_3_script ----------

list_item = ListItem(List=contours_total, Index=0, Wrap=True)

# ----
# Beta_Infill generation
# Generates an infill pattern
infill_generation = Infill_generation(
    strand_distance=strand_distance,
    first_layer_angle=first_layer_angle,
    y=python_3_script.a,
    object_contours=object_contours,
    pores_dimensions=pores_dimensions)

# ----
# Beta_Multiplication and
# rotation_2
moltiplication_and_rotation = MoltiplicationAndRotation(
    contours_total=contours_total,
    geometry=object_contours,
    infill=infill_generation,
    factor=layer_thickness,
    number_of_layers=number_of_layers,
    x=angle_of_rotation,
    infill_type=type_of_infill)

list_item_2 = ListItem(List=moltiplication_and_rotation, Index=0, Wrap=True)
sliced_part = ClusterOutput(moltiplication_and_rotation)  # Sliced Part

# ==== cluster GraphGenerator
geometry = ClusterInput()  # Geometry
control_points = ControlPoints(Curve=geometry)  # -> Points, Weights, Knots
explode = Explode(Geometry=geometry, Recursive=True)  # -> flatten(Segments), flatten(Vertices)
segments = ClusterOutput(explode.Segments)  # Segments
clean_tree = CleanTree(RemoveNulls=True, RemoveInvalid=True, RemoveEmpty=False, Tree=explode.Vertices)  # -> flatten(Tree)

# ----
# Graph Generation
explode_2 = Explode(Geometry=geometry, Recursive=True)  # -> flatten(Segments), flatten(Vertices)
removeduplicatepts = RemoveDuplicatePts(Points=clean_tree, Tolerance=0.01)
dupln = RemoveDuplicateLines(Lines=explode.Segments, Tolerance=0.001)
removeduplicatepts_2 = RemoveDuplicatePts(Points=explode_2.Vertices, Tolerance=0.001)
end_points = EndPoints(Curve=explode.Segments)  # -> Start, End
nodes = Panel(clean_tree)
ending_nodes = Panel(end_points.End)
nodes_2 = Panel(removeduplicatepts_2)

bake_attributes = BakeAttributes(Geometry=removeduplicatepts)
panel = Panel(end_points.Start)
python_3_script = Python3Script(list1=nodes, start_points=panel, end_points=ending_nodes)  # -> out, simplify(a), simplify(b); inputs list1: list, start_points: list, end_points: list
# ---------- python_3_script: Python ----------
import rhinoscriptsyntax as rs

# Function to convert '{x, y, z}' strings into tuples of floats
def parse_point(pt_str, precision=6):
    pt_str = pt_str.strip("{}")  # Remove curly braces
    coords = pt_str.split(",")  # Split into components
    return tuple(round(float(coord.strip()), precision) for coord in coords)

# Convert all inputs into properly formatted tuples
list1_tuples = [parse_point(pt) for pt in list1]
start_points_tuples = [parse_point(pt) for pt in start_points]
end_points_tuples = [parse_point(pt) for pt in end_points]

# Debugging output to check correct parsing
print("Parsed list1 first few points:", list1_tuples[:5])
print("Parsed start_points first few:", start_points_tuples[:5])
print("Parsed end_points first few:", end_points_tuples[:5])


# Create a dictionary for fast index lookup
index_map = {pt: i for i, pt in enumerate(list1_tuples)}

# Function to retrieve indices from dictionary
def get_indices(points):
    indices = []
    for pt in points:
        idx = index_map.get(pt, -1)  # Get index or return -1 if not found
        if idx == -1:
            print(f"⚠️ Warning: Point {pt} not found in list1!")  # Debug missing points
        indices.append(idx)
    return indices

# Compute start and end indices
start_indices = get_indices(start_points_tuples)
end_indices = get_indices(end_points_tuples)

# Output
a = start_indices
b = end_indices
# ---------- end python_3_script ----------

starting_indeces = Panel(python_3_script.a)
ending_indeces = Panel(python_3_script.b)

ends_indeces_txt = ClusterOutput(python_3_script.b)  # Ends_Indeces.txt
starts_indeces_txt = ClusterOutput(python_3_script.a)  # Starts_Indeces.txt
end = ClusterOutput(end_points.End)
start = ClusterOutput(end_points.Start)
global_nodes = ClusterOutput(nodes_2)  # Global Nodes
nodes_3 = ClusterOutput(nodes)  # Nodes

# ==== cluster Cluster_4
ends_indeces = ClusterInput()  # Ends_Indeces
start_indeces = ClusterInput()  # Start_Indeces
input_design_parameters = ClusterInput()  # Input Design Parameters
segments = ClusterInput()  # Segments
nodes = ClusterInput()
toggle = ClusterInput()
python_3_script = Python3Script(toggle=toggle)  # -> out, simplify(a)
# ---------- python_3_script: Python ----------
import rhinoscriptsyntax as rs
import os

# Define a function to execute when the toggle is switched on
def execute_script():
    # Open file selection dialog to choose directory and filename
    filter = "Text Files (*.txt)|*.txt|All Files (*.*)|*.*||"
    file_path = rs.OpenFileName("Select or create a file", filter)
    
    # Check if user canceled the operation
    if not file_path:
        print("Operation canceled.")
        return None
    
    # Get the directory and prefix of the selected file
    folder = os.path.dirname(file_path)
    selected_filename = os.path.basename(file_path)
    prefix = selected_filename.split('_')[0] + "_"
    
    # Find all files in the folder with the same prefix
    matching_files = [f for f in os.listdir(folder) if f.startswith(prefix) and f.endswith('.txt')]
    matching_files.sort()  # Sort to ensure order (e.g., file_1, file_2, etc.)
    
    # Read and append data from all matching files
    all_data = []
    for filename in matching_files:
        file_full_path = os.path.join(folder, filename)
        with open(file_full_path, 'r') as nodes:
            data = [[int(b) for b in row.split()] for row in nodes]
            all_data.extend(data)  # Append to the main list
    
    print(all_data)
    return all_data

# Main execution
if toggle:  # Assuming 'toggle' is the name of your Toggle component
    # Execute the script only if the toggle is switched on
    script_result = execute_script()
    # Output the result back to Grasshopper
    a = script_result
# ---------- end python_3_script ----------
ghpython_script = GhPythonScript()  # -> out, a
# ---------- ghpython_script: Python ----------
__author__ = "P70070779"
__version__ = "2024.03.14"

import rhinoscriptsyntax as rs
import os
from ghpythonlib import treehelpers
from ghpythonlib import components as ghcomp


# Define a function to execute when the toggle is switched on
def execute_script():
    # Open file selection dialog to choose directory and filename
    filter = "Text Files (*.txt)|*.txt|All Files (*.*)|*.*||"
    file_path = rs.OpenFileName("Select or create a file", filter)
    
    # Check if user canceled the operation
    if not file_path:
        print("Operation canceled.")
        return None
    
    # Read data from the selected file
    with open(file_path, 'r') as nodes:
        data = []
        for row in nodes:
            data.append([int(b) for b in row.split()])

    print(data)
    return data

# Main execution
if toggle:  # Assuming 'toggle' is the name of your Toggle component
    # Execute the script only if the toggle is switched on
    script_result = execute_script()
    # Output the result back to Grasshopper
    a = script_result
# ---------- end ghpython_script ----------
python_3_script_2 = Python3Script(x=start_indeces, y=ends_indeces)  # -> out, a; inputs x: list, y: list
# ---------- python_3_script_2: Python ----------
output_list = list(zip(x, y))

a=output_list
# ---------- end python_3_script_2 ----------
panel = Panel("80")

# ----
# Nodes to Printing
# Path Translation
explode_tree = ExplodeTree(InputDesignParameters=input_design_parameters)  # -> Branch0, Branch1, Branch2, Branch3, Branch4, Branch5, Branch6, Branch7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
pylist2tree = PythonListToGHTree(list=python_3_script.a)  # -> out, tree_out; inputs list: list
# ---------- pylist2tree: Python ----------
import collections
from Grasshopper import DataTree
from Grasshopper.Kernel.Data import GH_Path
from Grasshopper.Kernel import GH_Author

ghenv.Component.Name = 'python list to GH tree'
ghenv.Component.NickName = 'pyList2Tree'



"""
Python List to Grasshopper Tree - Component
by Andrei Nejur 

takes a nested python list an outputs the corespnding GH Tree with
each list element on its coresponding branch. Works with as many nested 
levels as needed.
Just plug the nested python list in the list input. 
Out prints a list of the created tree branches .


Use it for whatever you need 
"""


def unpackList(lst, path=GH_Path(0)):
    tree = DataTree[object]()
    
    for elem in lst:
        
        if isinstance(elem, collections.Iterable):
            tree.MergeTree(unpackList(elem,path.AppendElement(0)))
        else:
            print(path)
            tree.Add(elem,path)
        path = path.Increment(-1)
    return tree



tree_out = unpackList(list)
# ---------- end pylist2tree ----------

subtraction = Subtraction(A=pylist2tree.tree_out, B="1")
panel_2 = Panel(subtraction)

path_mapper = PathMapper(subtraction, source="{A;B}", target="{A}")
list_item = ListItem(Nodes=nodes, Index=path_mapper, Wrap=True)

python_3_script_3 = Python3Script(x=python_3_script_2.a, y=path_mapper)  # -> out, a; inputs x: list, y: list
# ---------- python_3_script_3: Python ----------
# Inputs: paired_list and number_list (from Grasshopper)
indices = []

for i in range(len(y) - 1):
    pair = (y[i], y[i + 1])
    if pair in x:
        idx = x.index(pair)
    else:
        # Since it's guaranteed that (y,x) exists if (x,y) doesn't,
        # we directly look for the reversed pair.
        pair = (y[i+1], y[i])
        idx = x.index(pair)
    indices.append(idx)

# Output the list of indices
a = indices
# ---------- end python_3_script_3 ----------
python_3_script_4 = Python3Script(x=python_3_script_2.a, y=path_mapper)  # -> out, a; inputs x: list, y: list
# ---------- python_3_script_4: Python ----------
# Option 1: Flatten all indices into one list
indices = []
print (y)
for i in range(len(y) - 1):
    pair = (y[i], y[i + 1])
    if pair in x:
        print (pair)
        print ('check 1')
        idx = x.index(pair)
        print (idx)
    else:
        print (pair)
        print ('check 2')
            # Since you're guaranteed that if (x, y) is not found, (y, x) is present
        pair = (y[i+1], y[i])
        idx = x.index(pair)
        print(idx)
    indices.append(idx)

a = indices
# ---------- end python_3_script_4 ----------
partition_list = PartitionList(List=python_3_script_3.a, Size=flatten(subtraction))  # -> simplify(Chunks)

panel_3 = Panel(python_3_script_3.a)

list_item_2 = ListItem(Nodes=segments, Index=python_3_script_4.a, Wrap=True)
polyline = PolyLine(Vertices=list_item, Closed=False)
divide_curve = DivideCurve(Curve=polyline, Count=explode_tree.Branch10, Kinks=False)  # -> Points, Tangents, Parameters
i = ClusterOutput(list_item)
panel_4 = Panel(polyline)
segments_out = ClusterOutput(list_item_2)  # Segments OUT
list_item_3 = ListItem(List=flatten(polyline), Index=Slider(884, range=0..1000), Wrap=True)

# ==== cluster Handles_v2
input_design_parameters = ClusterInput()
number_of_layers = ClusterInput()  # Number of Layers
layer_thickness = ClusterInput()  # Layer Thickness
optimized_path = ClusterInput()  # Optimized Path
handles_design = HandlesDesign(input_design_parameters=input_design_parameters, x_length=Domain(-5, 5))  # -> lines_handle1, lines_handle2, handle1, handle2
explode = Explode(Recursive=True)  # -> Segments, Vertices
polyline = PolyLine(Vertices=optimized_path, Closed=False)
unit_z = UnitZ(Factor=layer_thickness)
linear_array = LinearArray(Geometry=handles_design.lines_handle2, Direction=unit_z, Count=number_of_layers)  # -> simplify(Geometry), Transform
linear_array_2 = LinearArray(Geometry=handles_design.lines_handle1, Direction=unit_z, Count=number_of_layers)  # -> simplify(Geometry), Transform
end_points = EndPoints(Curve=polyline)  # -> Start, End
list_length = ListLength(List=flatten(linear_array_2.Geometry))
division = Division(A=list_length, B=number_of_layers)
python_3_script = Python3Script(x=layer_thickness, y=number_of_layers)  # -> out, a; inputs x: Double, y: Int32; same code as python_3_script_3
partition_list = PartitionList(List=flatten(linear_array.Geometry), Size=division)  # -> simplify(Chunks)
deconstruct = Deconstruct(Point=end_points.Start)  # -> XComponent, YComponent, simplify(flatten(ZComponent))
round_to_decimal_place = RoundToDecimalPlace(NumberX=deconstruct.ZComponent, DecimalPlace=1, RoundType=0)  # -> Rounded, Difference
python_3_script_2 = Python3Script(x=flatten(round_to_decimal_place.Rounded), y=python_3_script.a)  # -> out, a; inputs x: list of Double, y: list; same code as python_3_script_4
partition_list_2 = PartitionList(List=flatten(linear_array_2.Geometry), Size=division)  # -> simplify(Chunks)
partition_list_3 = PartitionList(List=flatten(polyline), Size=python_3_script_2.a)  # -> simplify(Chunks)
merge = Merge(Data1=partition_list_3, Data2=partition_list_2, Data3=partition_list)  # -> simplify(Result)
explode_2 = Explode(Curve=merge, Recursive=True)  # -> Segments, OptimizedScaffoldWHandles
optimized_scaffold_w_handles = ClusterOutput(explode_2.OptimizedScaffoldWHandles)

# ==== cluster Beta_ContourCreation
optimized_path = ClusterInput()  # Optimized Path
layer_thickness = ClusterInput()  # Layer Thickness
number_of_layers = ClusterInput()  # Number of Layers
contours = ClusterInput()  # Contours
polyline = PolyLine(Vertices=optimized_path, Closed=False)
python_3_script = Python3Script(x=layer_thickness, y=number_of_layers)  # -> out, a; inputs x: Double, y: Int32; same code as python_3_script_3
end_points = EndPoints(Curve=polyline)  # -> Start, End
partition_list = PartitionList(List=flatten(contours), Size="1")  # -> simplify(Chunks)
deconstruct = Deconstruct(Point=end_points.Start)  # -> XComponent, YComponent, simplify(flatten(ZComponent))
round_to_decimal_place = RoundToDecimalPlace(NumberX=deconstruct.ZComponent, DecimalPlace=1, RoundType=0)  # -> Rounded, Difference
python_3_script_2 = Python3Script(x=flatten(round_to_decimal_place.Rounded), y=python_3_script.a)  # -> out, a; inputs x: list of Double, y: list; same code as python_3_script_4
partition_list_2 = PartitionList(List=flatten(polyline), Size=python_3_script_2.a)  # -> simplify(Chunks)
merge = Merge(Data1=partition_list, Data2=partition_list_2)  # -> simplify(Result)
explode = Explode(Curve=merge, Recursive=True)  # -> Segments, Vertices
layers_w_contour = ClusterOutput(explode.Vertices)  # Layers w/contour

# ==== cluster Infill_generation
pores_dimensions = ClusterInput()  # Pores dimensions
object_contours = ClusterInput()  # Object Contours

# ----
# Arrowheads - OLD
x_array = Slider(12, range=1..100)
y_array = Slider(19, range=1..100)
x_y_size = Slider(1.62, range=0..100)
cluster = Cluster(x_y_size=x_y_size, x_array=x_array, y_array=y_array)
multiplication = Multiplication(A=x_y_size, B=y_array)
multiplication_2 = Multiplication(A=x_y_size, B=x_array)
division = Division(A=multiplication_2, B="-2")
division_2 = Division(A=multiplication, B="-2")
unit_x = UnitX(Factor=division)
unit_y = UnitY(Factor=division_2)
vector_xyz = VectorXYZ(XComponent=unit_x, YComponent=unit_y, ZComponent=0)  # -> expr("-x", Vector), Length
move = Move(Geometry=cluster, Motion=vector_xyz.Vector)  # -> Geometry, Transform
brep_curve = BrepCurve(Brep=object_contours, Curve=move.Geometry)  # -> flatten(Arrowheads), Points
explode = Explode(Curve=graft(brep_curve.Arrowheads), Recursive=True)  # -> flatten(Segments), flatten(Vertices)

explode_tree = ExplodeTree(Data=pores_dimensions)  # -> Branch0, Branch1, Branch2, Branch3, Branch4, Branch5, Branch6, Branch7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
strand_distance = ClusterInput()
first_layer_angle = ClusterInput()
y = ClusterInput()
python_3_script = Python3Script(x=object_contours, y=y)  # -> out, a; inputs x: list, y: Int32
# ---------- python_3_script: Python ----------
if y==4:
    a=x
else:
    a=[]
# ---------- end python_3_script ----------
deconstruct_domain² = DeconstructDomain²(Domain=python_3_script.a)  # -> UMin, UMax, VMin, VMax
bounding_box = BoundingBox(Content=python_3_script.a, Plane=PlaneXY(0, 0, 0))  # -> Box, Box_2
python_3_script_2 = Python3Script(x=object_contours, y=y)  # -> out, a; inputs x: list, y: Int32
# ---------- python_3_script_2: Python ----------
if y==0:
    a=x
else:
    a=[]
# ---------- end python_3_script_2 ----------
python_3_script_3 = Python3Script(x=object_contours, y=y)  # -> out, a; inputs x: list, y: Int32
# ---------- python_3_script_3: Python ----------
if y==3:
    a=x
else:
    a=[]
# ---------- end python_3_script_3 ----------
deconstruct_box = DeconstructBox(Box=bounding_box.Box)  # -> Plane, X, Y, Z
python_3_script_4 = Python3Script(x=object_contours, y=y)  # -> out, a; inputs x: list, y: Int32
# ---------- python_3_script_4: Python ----------
if y==1:
    a=x
else:
    a=[]
# ---------- end python_3_script_4 ----------
deconstruct_domain = DeconstructDomain(Domain=deconstruct_box.X)  # -> Start, End
deconstruct_domain_2 = DeconstructDomain(Domain=deconstruct_box.Y)  # -> Start, End
deconstruct_domain²_2 = DeconstructDomain²(Domain=python_3_script_2.a)  # -> UMin, UMax, VMin, VMax
number_slider = Slider(2.07, range=1..10)
number_slider_2 = Slider(3.434, range=1..10)
bounding_box_2 = BoundingBox(Content=python_3_script_4.a, Plane=PlaneXY(0, 0, 0))  # -> Box, Box_2
python_3_script_5 = Python3Script(x=object_contours, y=y)  # -> out, a; inputs x: list, y: Int32
# ---------- python_3_script_5: Python ----------
if y==2:
    a=x
else:
    a=[]
# ---------- end python_3_script_5 ----------
python_3_script_6 = Python3Script(x=object_contours, y=y)  # -> out, a; inputs x: list, y: Int32
# ---------- python_3_script_6: Python ----------
if y==5:
    a=x
else:
    a=[]
# ---------- end python_3_script_6 ----------
bounding_box_3 = BoundingBox(Content=python_3_script_5.a, Plane=PlaneXY(0, 0, 0))  # -> Box, Box_2
subtraction = Subtraction(A=deconstruct_domain_2.Start, B="7")
addition = Addition(A=deconstruct_domain.End, B="7")
addition_2 = Addition(A=deconstruct_domain_2.End, B="7")
deconstruct_box_2 = DeconstructBox(Box=bounding_box_2.Box)  # -> Plane, X, Y, Z
subtraction_2 = Subtraction(A=deconstruct_domain.Start, B="7")
bounding_box_4 = BoundingBox(Content=python_3_script_6.a, Plane=PlaneXY(0, 0, 0))  # -> Box, Box_2
pi = Pi(Factor=1)
construct_domain = ConstructDomain(DomainStart=subtraction_2, DomainEnd=addition)
construct_domain_2 = ConstructDomain(DomainStart=subtraction, DomainEnd=addition_2)

# ---- group: Domain calculation
deconstruct_domain²_3 = DeconstructDomain²(Domain=python_3_script_3.a)  # -> UMin, UMax, VMin, VMax
rectangle = Rectangle(Plane=PlaneXY(0, 0, 0), XSize=construct_domain, YSize=construct_domain_2, Radius=0)  # -> Rectangle, Length
addition_3 = Addition(A=deconstruct_domain²_3.UMax, B="2")
subtraction_3 = Subtraction(A=deconstruct_domain²_3.UMin, B="2")
subtraction_4 = Subtraction(A=deconstruct_domain²_3.VMin, B="2")
addition_4 = Addition(A=deconstruct_domain²_3.VMax, B="2")
explode_2 = Explode(Curve=rectangle.Rectangle, Recursive=True)  # -> Segments, Vertices
construct_domain_3 = ConstructDomain(DomainStart=subtraction_4, DomainEnd=addition_4)
list_item = ListItem(List=explode_2.Segments, Index=1, Wrap=True)
construct_domain_4 = ConstructDomain(DomainStart=subtraction_3, DomainEnd=addition_3)
list_item_2 = ListItem(List=explode_2.Segments, Index=0, Wrap=True)
length = Length(Curve=list_item)
length_2 = Length(Curve=list_item_2)
division_3 = Division(A=length, B=explode_tree.Branch4)
division_4 = Division(A=length_2, B=explode_tree.Branch4)
addition_5 = Addition(A=division_3, B="10")
addition_6 = Addition(A=division_4, B="10")

# ----
deconstruct_box_3 = DeconstructBox(Box=bounding_box_3.Box)  # -> Plane, X, Y, Z
deconstruct_domain_3 = DeconstructDomain(Domain=deconstruct_box_2.Y)  # -> Start, End
deconstruct_domain_4 = DeconstructDomain(Domain=deconstruct_box_2.X)  # -> Start, End
deconstruct_box_4 = DeconstructBox(Box=bounding_box_4.Box)  # -> Plane, X, Y, Z
pi_2 = Pi(Factor=1)
deconstruct_domain_5 = DeconstructDomain(Domain=deconstruct_box_3.Y)  # -> Start, End
deconstruct_domain_6 = DeconstructDomain(Domain=deconstruct_box_3.X)  # -> Start, End
deconstruct_domain_7 = DeconstructDomain(Domain=deconstruct_box_4.X)  # -> Start, End
deconstruct_domain_8 = DeconstructDomain(Domain=deconstruct_box_4.Y)  # -> Start, End
absolute = Absolute(Value=deconstruct_domain_4.End)
absolute_2 = Absolute(Value=deconstruct_domain_4.Start)
absolute_3 = Absolute(Value=deconstruct_domain_3.Start)
absolute_4 = Absolute(Value=deconstruct_domain_3.End)
absolute_5 = Absolute(Value=deconstruct_domain_6.Start)
xy_plane = XYPlane(Origin=Point(0, 0, 0))
negative = Negative(Value=addition_3)
absolute_6 = Absolute(Value=deconstruct_domain_6.End)
absolute_7 = Absolute(Value=deconstruct_domain_5.Start)
absolute_8 = Absolute(Value=deconstruct_domain_5.End)
addition_7 = Addition(A=absolute_3, B=absolute_4)
addition_8 = Addition(A=absolute_2, B=absolute)
division_5 = Division(A=addition_8, B=pi_2)
round = Round(Number=division_5)  # -> Nearest, Floor, Ceiling
construct_domain_5 = ConstructDomain(DomainStart=subtraction_3, DomainEnd=addition_3)
construct_domain_6 = ConstructDomain(DomainStart=subtraction_4, DomainEnd=addition_4)
absolute_9 = Absolute(Value=deconstruct_domain_7.End)
absolute_10 = Absolute(Value=deconstruct_domain_7.Start)
absolute_11 = Absolute(Value=deconstruct_domain_8.Start)
absolute_12 = Absolute(Value=deconstruct_domain_8.End)
construct_point = ConstructPoint(XCoordinate=deconstruct_domain_7.Start, YCoordinate=deconstruct_domain_8.Start, ZCoordinate=0)
rectangle_2 = Rectangle(Plane=xy_plane, XSize=explode_tree.Branch7, YSize=Slider(6.81, range=1..10), Radius=0)  # -> Rectangle, Length
bounding_box_5 = BoundingBox(Content=object_contours, Plane=PlaneXY(0, 0, 0))  # -> Box, Box_2
addition_9 = Addition(A=deconstruct_domain_6.End, B=5)
list_item_3 = ListItem(List=explode_2.Segments, Index=0, Wrap=True)
list_item_4 = ListItem(List=explode_2.Segments, Index=1, Wrap=True)
subtraction_5 = Subtraction(A=absolute_5, B=5)
addition_10 = Addition(A=absolute_5, B=absolute_6)
division_6 = Division(A=addition_10, B=pi)
round_2 = Round(Number=division_6)  # -> Nearest, Floor, Ceiling
addition_11 = Addition(A=absolute_7, B=absolute_8)
addition_12 = Addition(A=absolute_10, B=absolute_9)
addition_13 = Addition(A=absolute_11, B=absolute_12)
addition_14 = Addition(A=absolute, B=5)
length_3 = Length(Curve=list_item_4)
length_4 = Length(Curve=list_item_3)
subtraction_6 = Subtraction(A=absolute_2, B=5)
multiplication_3 = Multiplication(A=addition_8, B=50)
deconstruct_box_5 = DeconstructBox(Box=bounding_box_5.Box)  # -> Plane, X, Y, Z
division_7 = Division(A=length_3, B=explode_tree.Branch11)
multiplication_4 = Multiplication(A=addition_10, B=1000)
division_8 = Division(A=length_4, B=explode_tree.Branch10)
deconstruct_domain_9 = DeconstructDomain(Domain=deconstruct_box_5.X)  # -> Start, End
deconstruct_domain_10 = DeconstructDomain(Domain=deconstruct_box_5.Y)  # -> Start, End
panel = Panel("5000")
area = Area(Geometry=bounding_box_5.Box)  # -> Area, Centroid
addition_15 = Addition(A=division_7, B="50")
addition_16 = Addition(A=division_8, B="50")
number_slider_3 = Slider(1.565, range=0..4)
negative_2 = Negative(Value=area.Centroid)
construct_point_2 = ConstructPoint(XCoordinate=subtraction_2, YCoordinate=subtraction, ZCoordinate=0)
area_2 = Area(Geometry=object_contours)  # -> Area, Centroid

# ----
# Honeycomb
number_of_y_hexagons = Slider(200, range=0..200)
number_of_x_hexagons = Slider(200, range=0..200)
panel_2 = Panel("{-5,-5,0}")
xy_plane_2 = XYPlane(Origin=construct_point_2)
# Auxetic Designs
hexagonal = Hexagonal(Plane=xy_plane_2, Size=explode_tree.Branch4, ExtentX=addition_6, ExtentY=addition_5)  # -> Cells, Points
rotate = Rotate(Geometry=hexagonal.Cells, FirstLayerAngle=degrees(first_layer_angle), Plane=PlaneXY(0, 0, 0))  # -> Geometry, Transform

division_9 = Division(A=addition_7, B=explode_tree.Branch0)
panel_3 = Panel("0.05")
panel_4 = Panel("0.5")
panel_5 = Panel("25")
addition_17 = Addition(A=division_9, B=5)
multiplication_5 = Multiplication(A=division_9, B=2)

# ----
# Sinusoidal Infill Lines w. Rotation Option
# Note: No Meander; Turn border closed curves into surfaces
number_slider_4 = Slider(5.608, range=0..10)
pi_3 = Pi(Factor=round.Ceiling)
negative_3 = Negative(Value=pi_3)
number_of_points = Slider(200, range=0..200)
construct_domain_7 = ConstructDomain(DomainStart=subtraction_6, DomainEnd=addition_14)
range = Range(Domain=construct_domain_7, Steps=multiplication_3)
expression = Expression(A=explode_tree.Branch0, x=range, w=explode_tree.Branch1, Expression="A*sin(w*x)")
# Line-Based Infill
construct_point_3 = ConstructPoint(XCoordinate=range, YCoordinate=expression, ZCoordinate=0)
number_of_lines = Slider(38, range=1..60)
unit_y_2 = UnitY(StrandDistance=strand_distance)
polyline = PolyLine(Vertices=construct_point_3, Closed=False)
negative_4 = Negative(StrandDistance=strand_distance)
number_of_lines_2 = Slider(38, range=1..60)
linear_array = LinearArray(Geometry=polyline, Direction=unit_y_2, Count=multiplication_5)  # -> Geometry, Transform
unit_y_3 = UnitY(Factor=negative_4)
linear_array_2 = LinearArray(Geometry=polyline, Direction=unit_y_3, Count=3)  # -> reverse(Geometry), Transform
merge = Merge(Data1=linear_array_2.Geometry, Data2=linear_array.Geometry)
rotate_2 = Rotate(Geometry=merge, FirstLayerAngle=degrees(first_layer_angle), Plane=PlaneXY(0, 0, 0))  # -> Geometry, Transform

python_3_script_7 = Python3Script(x=negative_2, y=y)  # -> out, a, b, c, d, e; inputs x: list of Point3d, y: Int32
# ---------- python_3_script_7: Python ----------
if 0<y<=6:
    a=0
    b=0
    c=0
    d=0
    e=0
elif y==7:
    a=x
    b=0
    c=0
    d=0
    e=0
elif y==8:
    a=0
    b=x
    c=0
    d=0
    e=0
elif y==9:
    a=0
    b=0
    c=x
    d=0
    e=0
elif y==10:
    a=0
    b=0
    c=0
    d=x
    e=0
elif y==11:
    a=x
    b=0
    c=0
    d=0
    e=x
else:
    a=0
    b=0
    c=0
    d=0
    e=0
# ---------- end python_3_script_7 ----------
division_10 = Division(A=addition_11, B=explode_tree.Branch0)
multiplication_6 = Multiplication(A=division_10, B=2)
explode_3 = Explode(Curve=hexagonal.Cells, Recursive=True)  # -> Segments, Vertices
python_3_script_8 = Python3Script(x=object_contours, y=y)  # -> out, a; inputs x: list, y: Int32
# ---------- python_3_script_8: Python ----------
if y==6:
    a=x
else:
    a=[]
# ---------- end python_3_script_8 ----------
removeduplicatelines = RemoveDuplicateLines(Lines=flatten(explode_3.Segments), Tolerance=0.01)
deconstruct_domain²_4 = DeconstructDomain²(Domain=python_3_script_8.a)  # -> UMin, UMax, VMin, VMax
bounding_box_6 = BoundingBox(Content=python_3_script_8.a, Plane=PlaneXY(0, 0, 0))  # -> Box, Box_2
deconstruct_box_6 = DeconstructBox(Box=bounding_box_6.Box)  # -> Plane, X, Y, Z
deconstruct_domain_11 = DeconstructDomain(Domain=deconstruct_box_6.X)  # -> Start, End
deconstruct_domain_12 = DeconstructDomain(Domain=deconstruct_box_6.Y)  # -> Start, End
construct_point_4 = ConstructPoint(XCoordinate=deconstruct_domain_11.Start, YCoordinate=deconstruct_domain_12.Start, ZCoordinate=0)
absolute_13 = Absolute(Value=deconstruct_domain_11.End)
absolute_14 = Absolute(Value=deconstruct_domain_11.Start)
absolute_15 = Absolute(Value=deconstruct_domain_12.Start)
absolute_16 = Absolute(Value=deconstruct_domain_12.End)
addition_18 = Addition(A=absolute_14, B=absolute_13)
division_11 = Division(A=addition_18, B=explode_tree.Branch10)
round_3 = Round(Number=division_11)  # -> Nearest, Floor, Ceiling
addition_19 = Addition(A=round_3.Ceiling, B=10)
addition_20 = Addition(A=absolute_15, B=absolute_16)
division_12 = Division(A=addition_20, B=explode_tree.Branch11)
round_4 = Round(Number=division_12)  # -> Nearest, Floor, Ceiling
addition_21 = Addition(A=round_4.Ceiling, B=10)

# ----
# Re-entrant Honeycomb
number_slider_5 = Slider(5, range=1..10)
number_slider_6 = Slider(4.75, range=1..10)
xy_plane_3 = XYPlane(Origin=Point(0, 0, 0))
rectangle_3 = Rectangle(Plane=xy_plane_3, XSize=explode_tree.Branch10, YSize=explode_tree.Branch11, Radius=0)  # -> Rectangle, Length
explode_4 = Explode(Curve=rectangle_3.Rectangle, Recursive=True)  # -> Segments, Vertices
panel_6 = Panel("""0
2""")
list_item_5 = ListItem(List=explode_4.Segments, Index=panel_6, Wrap=True)  # -> graft(Item)
number_slider_7 = Slider(0.626, range=0..4)
end_points = EndPoints(Curve=list_item_5)  # -> Start, End
curve_middle = CurveMiddle(Curve=list_item_5)
negative_5 = Negative(Value=explode_tree.Branch12)
weave = Weave(Pattern=[0, 1], Stream0=end_points.Start, Stream1=end_points.End, NullGaps=False)  # -> flatten(Weave)
unit_y_4 = UnitY(Factor=[explode_tree.Branch12, negative_5])  # -> graft(UnitVector)
move_2 = Move(Geometry=curve_middle, Motion=unit_y_4)  # -> Geometry, Transform
insert_items = InsertItems(List=weave, Item=flatten(move_2.Geometry), Indices=[1, 3], Wrap=True)
subtraction_7 = Subtraction(A=explode_tree.Branch11, B=explode_tree.Branch12)
polyline_2 = PolyLine(Vertices=insert_items, Closed=True)
multiplication_7 = Multiplication(A=subtraction_7, B="2")
rectangle_4 = Rectangle(Plane=PlaneXY(0, 0, 0), XSize=explode_tree.Branch10, YSize=multiplication_7, Radius=0)  # -> Rectangle, Length
number_slider_8 = Slider(150, range=1..300)
number_slider_9 = Slider(150, range=1..300)
division_13 = Division(A=explode_tree.Branch10, B="2")
rectangular_array = RectangularArray(Geometry=polyline_2, Cell=rectangle_4.Rectangle, XCount=addition_19, YCount=addition_21)  # -> graft(Geometry), Transform
vector_xyz_2 = VectorXYZ(XComponent=division_13, YComponent=subtraction_7, ZComponent=0)  # -> Vector, Length
move_3 = Move(Geometry=rectangular_array.Geometry, Motion=vector_xyz_2.Vector)  # -> Geometry, Transform
merge_2 = Merge(Data1=rectangular_array.Geometry, Data2=move_3.Geometry)
move_4 = Move(Geometry=merge_2, Motion=construct_point_4)  # -> Geometry, Transform

unit_x_2 = UnitX(Factor=explode_tree.Branch7)
panel_7 = Panel("50")

# ----
# Triangular Function Infill w. Rotation Option
# Note: No Meander; Border should be turned to a surface
number_slider_10 = Slider(3.747, range=0..10)
pi_4 = Pi(Factor=round_2.Ceiling)
negative_6 = Negative(Value=pi_4)
number_slider_11 = Slider(1000, range=1..1000)
construct_domain_8 = ConstructDomain(DomainStart=subtraction_5, DomainEnd=addition_9)
range_2 = Range(Domain=construct_domain_8, Steps=multiplication_4)
expression_2 = Expression(x=range_2, a=explode_tree.Branch2, p=explode_tree.Branch3, Expression="((2*a)/π)*Asin(sin((2*π*x)/p))")
construct_point_5 = ConstructPoint(XCoordinate=range_2, YCoordinate=expression_2, ZCoordinate=0)
negative_7 = Negative(StrandDistance=strand_distance)
polyline_3 = PolyLine(Vertices=construct_point_5, Closed=False)
number_of_lines_3 = Slider(25, range=1..60)
unit_y_5 = UnitY(StrandDistance=strand_distance)
unit_y_6 = UnitY(Factor=negative_7)

explode_5 = Explode(Curve=polyline_3, Recursive=True)  # -> Segments, Vertices
join_curves = JoinCurves(Curves=explode_5.Segments, Preserve=False)
discontinuity = Discontinuity(Curve=join_curves, Level=1)  # -> Points, Parameters
polyline_4 = PolyLine(Vertices=discontinuity.Points, Closed=False)

linear_array_3 = LinearArray(Geometry=polyline_4, Direction=unit_y_6, Count=3)  # -> reverse(Geometry), Transform
linear_array_4 = LinearArray(Geometry=polyline_4, Direction=unit_y_5, Count=multiplication_6)  # -> Geometry, Transform
merge_3 = Merge(Data1=linear_array_3.Geometry, Data2=linear_array_4.Geometry)
rotate_3 = Rotate(Geometry=merge_3, FirstLayerAngle=degrees(first_layer_angle), Plane=PlaneXY(0, 0, 0))  # -> Triangles, Transform

explode_6 = Explode(Curve=rotate_3.Triangles, Recursive=True)  # -> Segments, Vertices
join_curves_2 = JoinCurves(Curves=explode_6.Segments, Preserve=False)

# ----
# Simple Parallel Line Infill w. Rotation Option
#          Note: Stop here for no meander
start_x = Panel("-15")
start_y = Panel("-10")
end_x = Panel("15")
unit_y_7 = UnitY(StrandDistance=strand_distance)
number_of_lines_4 = Slider(39, range=1..60)

addition_22 = Addition(A=deconstruct_domain²_2.UMax, B=end_x)
addition_23 = Addition(A=deconstruct_domain²_2.UMin, B=start_x)

construct_point_6 = ConstructPoint(XCoordinate=addition_23, YCoordinate=deconstruct_domain²_2.VMin, ZCoordinate=0)
construct_point_7 = ConstructPoint(XCoordinate=addition_22, YCoordinate=deconstruct_domain²_2.VMin, ZCoordinate=0)
line = Line(StartPoint=construct_point_6, EndPoint=construct_point_7)
linear_array_5 = LinearArray(Geometry=line, Direction=unit_y_7, Count=number_of_lines_4)  # -> Geometry, Transform
rotate_4 = Rotate(InfillLines=linear_array_5.Geometry, FirstLayerAngle=degrees(first_layer_angle), CenterOfOuterShape=PlaneXY(0, 0, 0))  # -> Geometry, Transform

brep_plane = BrepPlane(Brep=object_contours, Plane=PlaneXY(0, 0, 0))  # -> Curves, Points
explode_7 = Explode(Curve=rectangle_2.Rectangle, Recursive=True)  # -> Segments, Vertices

move_5 = Move(Geometry=explode_7.Segments, Motion=construct_point)  # -> Geometry, Transform

list_item_6 = ListItem(List=flatten(move_5.Geometry), Index=0, Wrap=True)
explode_8 = Explode(Curve=list_item_6, Recursive=True)  # -> Segments, Vertices
dispatch = Dispatch(List=explode_8.Vertices, DispatchPattern=[True, False])  # -> ListA, ListB
line_2 = Line(StartPoint=dispatch.ListA, EndPoint=dispatch.ListB)
divide_curve = DivideCurve(Curve=line_2, Count=Slider(1, range=1..21), Kinks=False)  # -> Points, Tangents, Parameters

list_item_7 = ListItem(List=divide_curve.Points, Index=0, Wrap=True)
list_item_8 = ListItem(List=divide_curve.Points, Index=1, Wrap=True)

shift_list = ShiftList(List=divide_curve.Points, Shift=1, Wrap=True)
# Arrowheads
line_3 = Line(StartPoint=list_item_7, EndPoint=list_item_8)
curve_middle_2 = CurveMiddle(Curve=line_3)
unit_y_8 = UnitY(Factor=explode_tree.Branch9)
move_6 = Move(Geometry=curve_middle_2, Motion=unit_y_8)  # -> Geometry, Transform
weave_2 = Weave(Pattern=[0, 1, 2], Stream0=divide_curve.Points, Stream1=move_6.Geometry, Stream2=shift_list, NullGaps=False)
removeduplicatepts = RemoveDuplicatePts(Points=weave_2, Tolerance=0.01)
polyline_5 = PolyLine(Vertices=removeduplicatepts, Closed=False)

shift_list_2 = ShiftList(List=divide_curve.Points, Shift=1, Wrap=True)
line_4 = Line(StartPoint=list_item_7, EndPoint=list_item_8)
curve_middle_3 = CurveMiddle(Curve=line_4)
unit_y_9 = UnitY(Factor=explode_tree.Branch8)
move_7 = Move(Geometry=curve_middle_3, Motion=unit_y_9)  # -> Geometry, Transform
weave_3 = Weave(Pattern=[0, 1, 2], Stream0=divide_curve.Points, Stream1=move_7.Geometry, Stream2=shift_list_2, NullGaps=False)
removeduplicatepts_2 = RemoveDuplicatePts(Points=weave_3, Tolerance=0.01)
polyline_6 = PolyLine(Vertices=removeduplicatepts_2, Closed=False)

length_5 = Length(Curve=line_4)
division_14 = Division(A=addition_12, B=length_5)
division_15 = Division(A=addition_13, B=length_5)
round_5 = Round(Number=division_14)  # -> Nearest, Floor, Ceiling
round_6 = Round(Number=division_15)  # -> Nearest, Floor, Ceiling
addition_24 = Addition(A=round_5.Ceiling, B=10)
multiplication_8 = Multiplication(A=round_5.Ceiling, B=2)
addition_25 = Addition(A=round_6.Ceiling, B=10)

subtraction_8 = Subtraction(A=explode_tree.Branch8, B=explode_tree.Branch9)
number_slider_12 = Slider(15, range=1..200)
join_curves_3 = JoinCurves(Curves=[polyline_5, polyline_6], Preserve=False)
unit_y_10 = UnitY(Factor=subtraction_8)
linear_array_6 = LinearArray(Geometry=join_curves_3, Direction=unit_y_10, Count=addition_25)  # -> Arrowheads, Transform

multiplication_9 = Multiplication(A=round_6.Ceiling, B=2)
linear_array_7 = LinearArray(Geometry=linear_array_6.Arrowheads, Direction=unit_x_2, Count=addition_24)  # -> Arrowheads, Transform

# ----
# Parakeet - Tiling
deconstruct_domain²_5 = DeconstructDomain²(Domain=object_contours)  # -> UMin, UMax, VMin, VMax
area_3 = Area(Geometry=object_contours)  # -> Area, Centroid
absolute_17 = Absolute(Value=deconstruct_domain_9.End)
absolute_18 = Absolute(Value=deconstruct_domain_9.Start)
absolute_19 = Absolute(Value=deconstruct_domain_10.Start)
absolute_20 = Absolute(Value=deconstruct_domain_10.End)
addition_26 = Addition(A=absolute_19, B=absolute_20)
addition_27 = Addition(A=absolute_18, B=absolute_17)
penrose = Penrose(Plane=area_3.Centroid, Size=explode_tree.Branch6, Iteration=5)

deconstruct = Deconstruct(Point=area_3.Centroid)  # -> XComponent, YComponent, ZComponent
division_16 = Division(A=addition_27, B=explode_tree.Branch6)
division_17 = Division(A=addition_26, B=explode_tree.Branch6)
construct_point_8 = ConstructPoint(XCoordinate=deconstruct_domain_9.Start, YCoordinate=deconstruct_domain_10.Start, ZCoordinate=deconstruct.ZComponent)
addition_28 = Addition(A=division_16, B="10")
division_18 = Division(A=division_17, B=2)
subtraction_9 = Subtraction(A=division_17, B="10")
addition_29 = Addition(A=addition_27, B="10")

rhombitrihexagonal = Rhombitrihexagonal(Plane=python_3_script_7.c, Size=explode_tree.Branch6, ExtendX=addition_28, ExtendY=division_17)
_2_uniform_tiling_c = _2UniformTilingC(Plane=python_3_script_7.d, Size=explode_tree.Branch6, ExtendX=addition_28, ExtendY=division_17)
_2_uniform_tiling_d = _2UniformTilingD(Plane=python_3_script_7.b, Size=explode_tree.Branch6, ExtendX=addition_28, ExtendY=division_17)
snub_square = SnubSquare(Plane=python_3_script_7.a, Size=explode_tree.Branch6, ExtendX=addition_28, ExtendY=division_17)

# ----
# Voronoi
rectangle_5 = Rectangle(Plane=PlaneXY(0, 0, 0), XSize=construct_domain_4, YSize=construct_domain_3, Radius=0)  # -> Rectangle, Length
seed = Slider(2, range=0..10)
voronoi_cell_radius = Slider(5.084, range=0..10)

area_4 = Area(Geometry=rectangle_5.Rectangle)  # -> Area, Centroid
division_19 = Division(A=area_4.Area, B=area_2.Area)
multiplication_10 = Multiplication(A=area_4.Area, B=explode_tree.Branch5)
vector_2pt = Vector2Pt(PointA=area_4.Centroid, PointB=area_2.Centroid, Unitize=False)  # -> Vector, Length
# Grids and Patterns
move_8 = Move(Geometry=rectangle_5.Rectangle, Motion=vector_2pt.Vector)  # -> Geometry, Transform

populate_2d = Populate2D(ObjectContours=move_8.Geometry, Count=multiplication_10, Seed=seed)
voronoi = Voronoi(Points=populate_2d, Radius=voronoi_cell_radius, Boundary=move_8.Geometry, BruteForceOverride=False)
rotate_5 = Rotate(Geometry=voronoi, FirstLayerAngle=degrees(first_layer_angle), Plane=PlaneXY(0, 0, 0))  # -> Geometry, Transform

explode_9 = Explode(Curve=voronoi, Recursive=True)  # -> Segments, Vertices
explode_10 = Explode(Curve=rotate_5.Geometry, Recursive=True)  # -> Segments, Vertices
stream_filter = StreamFilter(
    Gate=y,
    Stream0=rotate_4.Geometry,
    Stream1=rotate_2.Geometry,
    Stream2=join_curves_2,
    Stream3=rotate_5.Geometry,
    Stream4=rotate.Geometry,
    Stream5=linear_array_7.Arrowheads,
    Stream6=move_4.Geometry,
    Stream7=snub_square,
    Stream8=_2_uniform_tiling_d,
    Stream9=rhombitrihexagonal,
    Stream10=_2_uniform_tiling_c,
    Stream11=penrose)  # -> simplify(Stream)
explode_11 = Explode(Curve=stream_filter, Recursive=True)  # -> Segments, Vertices
removeduplicatelines_2 = RemoveDuplicateLines(Lines=flatten(explode_11.Segments), Tolerance=0.01)
merge_4 = Merge(Data2=removeduplicatelines_2)
infill = ClusterOutput(merge_4)  # Infill

# ==== cluster MoltiplicationAndRotation
infill = ClusterInput()  # Infill
factor = ClusterInput()
infill_type = ClusterInput()  # Infill type
number_of_layers = ClusterInput()  # Number of Layers
x = ClusterInput()
geometry = ClusterInput()
contours_total = ClusterInput()  # Contours Total
list_item = ListItem(List=graft(infill), Index=0, Wrap=True)
unit_z = UnitZ(Factor=factor)
python_3_script = Python3Script(x=infill, y=infill_type)  # -> out, a, b; inputs x: tree
# ---------- python_3_script: Python ----------
if y in [2,3,4,8,9,10,11,12]:
    a=x
    b=0
else:
    a=0
    b=1
# ---------- end python_3_script ----------
boundary_surfaces = BoundarySurfaces(Edges=infill)
list_item_2 = ListItem(List=flatten(contours_total), Index=0, Wrap=True)
python_3_script_2 = Python3Script(x=infill, y=infill_type)  # -> out, a, b; inputs x: tree
# ---------- python_3_script_2: Python ----------
if y not in [2,3,4,8,9,10,11,12]: 
    a=x
    b=1
else: a=0
# ---------- end python_3_script_2 ----------
linear_array = LinearArray(Geometry=graft(python_3_script.a), DirectionOfSlicing=unit_z, NumberOfLayers=number_of_layers)  # -> Geometry, Transform
area = Area(Geometry=boundary_surfaces)  # -> Area, Centroid
area_2 = Area(Geometry=geometry)  # -> Area, Centroid
ghpython_script = GhPythonScript(x=x, y=number_of_layers)  # -> out, a; inputs y: Int32
# ---------- ghpython_script: Python ----------
__author__ = "P70070779"
__version__ = "2022.07.26"

import rhinoscriptsyntax as rs

a=[0]
x=int(x)

for i in range(1,y):
    angle=x * i
    print(angle)
    print(i)
    a.append(angle)
# ---------- end ghpython_script ----------
bounding_box = BoundingBox(Content=list_item_2, Plane=PlaneXY(0, 0, 0))  # -> Box, Box_2
move_to_point = MoveToPoint(Geometry=python_3_script_2.a, PointA=area.Centroid, PointB=area_2.Centroid)  # -> Moved, Vector, Transform
explode = Explode(Curve=move_to_point.Moved, Recursive=True)  # -> Segments, Vertices
linear_array_2 = LinearArray(Geometry=graft(move_to_point.Moved), DirectionOfSlicing=unit_z, NumberOfLayers=number_of_layers)  # -> Geometry, Transform
deconstruct = Deconstruct(Point=explode.Vertices)  # -> XComponent, YComponent, ZComponent
deconstruct_box = DeconstructBox(Box=bounding_box.Box)  # -> Plane, X, Y, Z
rotate = Rotate(Geometry=linear_array_2.Geometry, Angle=degrees(ghpython_script.a), Plane=area_2.Centroid)  # -> Geometry, Transform
list_length = ListLength(List=flatten(infill))
sort_list = SortList(Keys=flatten(deconstruct.YComponent))  # -> Keys, ValuesValuesA
sort_list_2 = SortList(Keys=flatten(deconstruct.XComponent))  # -> Keys, ValuesValuesA
rotate_2 = Rotate(Geometry=linear_array.Geometry, Angle=degrees(ghpython_script.a), Plane=area_2.Centroid)  # -> Geometry, Transform
deconstruct_domain = DeconstructDomain(Domain=deconstruct_box.X)  # -> Start, End
deconstruct_domain_2 = DeconstructDomain(Domain=deconstruct_box.Y)  # -> Start, End
list_item_3 = ListItem(List=sort_list_2.Keys, Index=0, Wrap=True)
list_item_4 = ListItem(List=sort_list.Keys, Index=0, Wrap=True)
brep_curve = BrepCurve(ObjectContoursTotal=contours_total, Curve=flatten(rotate_2.Geometry))  # -> simplify(Curves), Points
construct_point = ConstructPoint(XCoordinate=deconstruct_domain.Start, YCoordinate=deconstruct_domain_2.Start, ZCoordinate=0)
partition_list = PartitionList(List=flatten(rotate.Geometry), Size=list_length)
construct_point_2 = ConstructPoint(XCoordinate=list_item_3, YCoordinate=list_item_4, ZCoordinate=0)
move_to_point_2 = MoveToPoint(Geometry=rotate.Geometry, PointA=construct_point_2, PointB=construct_point)  # -> Moved, Vector, Transform
brep_curve_2 = BrepCurve(ObjectContoursTotal=contours_total, Curve=flatten(move_to_point_2.Moved))  # -> simplify(Curves), Points
flip_matrix = FlipMatrix(Data=partition_list)
stream_filter = StreamFilter(Gate=python_3_script.b, Stream0=brep_curve.Curves, Stream1=brep_curve_2.Curves)
list_item_5 = ListItem(List=rotate.Geometry, Index=Slider(0, range=0..10), Wrap=True)
explode_2 = Explode(Curve=stream_filter, Recursive=True)  # -> Segments, Vertices
panel = Panel(number_of_layers)
python_3_script_3 = Python3Script(x=factor, y=number_of_layers)  # -> out, a; inputs x: Double
# ---------- python_3_script_3: Python ----------
a=[]
print(x)
for i in range(y):
    print(i)
    a.append(x*i)
    print(a)
# ---------- end python_3_script_3 ----------
end_points = EndPoints(Curve=explode_2.Segments)  # -> Start, End
deconstruct_2 = Deconstruct(Point=end_points.Start)  # -> XComponent, YComponent, simplify(flatten(ZComponent))
round_to_decimal_place = RoundToDecimalPlace(NumberX=deconstruct_2.ZComponent, DecimalPlace=1, RoundType=0)  # -> Rounded, Difference
python_3_script_4 = Python3Script(x=flatten(round_to_decimal_place.Rounded), y=python_3_script_3.a)  # -> out, a; inputs x: list of Double, y: list
# ---------- python_3_script_4: Python ----------
from collections import Counter

counts = Counter(x)

a = list(counts.values())

print(a)
print(counts)
# ---------- end python_3_script_4 ----------
partition_list_2 = PartitionList(List=flatten(stream_filter), Size=python_3_script_4.a)  # -> simplify(Chunks)
panel_2 = Panel(deconstruct_2.ZComponent)
sliced_part = ClusterOutput(partition_list_2)  # Sliced part

# ==== cluster HandlesDesign
input_design_parameters = ClusterInput()
explode_tree = ExplodeTree(InputDesignParameters=input_design_parameters)  # -> Branch0, Branch1, Branch2, Branch3, Branch4, Branch5, Branch6, Branch7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
explode_tree_2 = ExplodeTree()  # -> Branch0, Branch1
x_length = ClusterInput()  # X Length
angle_of_rotation = Slider(90, range=0..180)
angle_of_rotation_2 = Slider(90, range=0..180)

# ----
# Handle Design
number_slider = Slider(3, range=1..30)
xy_plane = XYPlane(Origin=Point(0, 0, 0))
negative = Negative(Value="5")
rectangle = Rectangle(Plane=xy_plane, XSize=x_length, YSize=number_slider, Radius=0)  # -> Rectangle, Length
unit_y = UnitY(Factor="5")
move = Move(Geometry=rectangle.Rectangle, Motion=unit_y)  # -> Geometry, Transform

subtraction = Subtraction(A=negative, B=number_slider)

unit_y_2 = UnitY(Factor=subtraction)
move_2 = Move(Geometry=rectangle.Rectangle, Motion=unit_y_2)  # -> Geometry, Transform

move_3 = Move(Geometry=move_2.Geometry, Motion="{5,5,0}")  # -> Geometry, Transform
move_4 = Move(Geometry=move.Geometry, Motion="{5,5,0}")  # -> Geometry, Transform
cluster = Cluster_5(
    outer_shape=move_3.Geometry,
    angle_of_rotation=angle_of_rotation,
    layer_thickness=explode_tree.Branch4,
    nozzle_diameter=explode_tree.Branch12)
cluster_2 = Cluster_5(
    outer_shape=move_4.Geometry,
    angle_of_rotation=angle_of_rotation_2,
    layer_thickness=explode_tree.Branch4,
    nozzle_diameter=explode_tree.Branch12)
lines_handle1 = ClusterOutput(cluster)  # Lines_handle1
explode = Explode(Curve=cluster, Recursive=True)  # -> Segments, Vertices
lines_handle2 = ClusterOutput(cluster_2)  # Lines_handle2
explode_2 = Explode(Curve=cluster_2, Recursive=True)  # -> Segments, Vertices
handle1 = ClusterOutput(explode.Vertices)  # handle1
handle2 = ClusterOutput(explode_2.Vertices)  # handle2

# ==== cluster Cluster
x_y_size = ClusterInput()
rectangle = Rectangle(Plane=PlaneXY(0, 0, 0), XSize=x_y_size, YSize=x_y_size, Radius=0)  # -> Rectangle, Length
crv = Curve(rectangle.Rectangle)
explode = Explode(Curve=crv, Recursive=True)  # -> Segments, Vertices
item = ListItem(List=explode.Segments, Index=Slider(2, range=0..5), Wrap=True)
item_2 = ListItem(List=explode.Vertices, Index=Slider(0, range=0..5), Wrap=True)
item_3 = ListItem(List=explode.Segments, Index=Slider(4, range=0..10), Wrap=True)
item_4 = ListItem(List=explode.Segments, Index=Slider(4, range=0..9), Wrap=True)
division = Division(A=x_y_size, B="3")
item_5 = ListItem(List=explode.Vertices, Index=Slider(1, range=0..5), Wrap=True)
midpt = CurveMiddle(Curve=item)
midpt_2 = CurveMiddle(Curve=item_4)
ln = Line(StartPoint=midpt, EndPoint=item_2)
Y = UnitY(Factor=division)
ln_2 = Line(StartPoint=midpt, EndPoint=item_5)
move = Move(Geometry=midpt_2, Motion=Y)  # -> Geometry, Transform
ln_3 = Line(StartPoint=item_2, EndPoint=move.Geometry)
ln_4 = Line(StartPoint=move.Geometry, EndPoint=item_5)
subtraction = Subtraction(A=x_y_size, B=division)
join = JoinCurves(Curves=[ln, ln_2, ln_3, ln_4], Preserve=False)
rectangle_2 = Rectangle(Plane=PlaneXY(0, 0, 0), XSize=x_y_size, YSize=subtraction, Radius=0)  # -> Rectangle, Length
y_array = ClusterInput()
x_array = ClusterInput()
arrbox = BoxArray(Geometry=join, Cell=rectangle_2.Rectangle, XCount=x_array, YCount=y_array, ZCount="1")  # -> Geometry_array, Transform
geometry_array = ClusterOutput(arrbox.Geometry_array)

# ==== cluster Cluster_5
nozzle_diameter = ClusterInput()
angle_of_rotation = ClusterInput()
outer_shape = ClusterInput()

# ----
# Simple Parallel Line Infill w. Rotation Option
#          Note: Stop here for no meander
start_x = Panel("-30")
start_y = Panel("-20")
end_x = Panel("30")
end_y = Panel("-20")
construct_point = ConstructPoint(XCoordinate=start_x, YCoordinate=start_y, ZCoordinate=0)
construct_point_2 = ConstructPoint(XCoordinate=end_x, YCoordinate=end_y, ZCoordinate=0)
line = Line(StartPoint=construct_point, EndPoint=construct_point_2)
number_of_lines = Slider(500, range=1..500)
unit_y = UnitY(NozzleDiameter=nozzle_diameter)
linear_array = LinearArray(Geometry=line, Direction=unit_y, Count=number_of_lines)  # -> Geometry, Transform
rotate = Rotate(InfillLines=linear_array.Geometry, AngleOfRotation=degrees(angle_of_rotation), CenterOfOuterShape=PlaneXY(0, 0, 0))  # -> Geometry, Transform
curve_curve = CurveCurve(InfillPattern=rotate.Geometry, OuterShape=outer_shape)  # -> Points, ParamsA, ParamsB

# ----
# Meander Option
dispatch = Dispatch(List=flatten(curve_curve.Points), DispatchPattern=[True, True, False, False])  # -> ListA, ListB
dispatch_2 = Dispatch(List=dispatch.ListB, DispatchPattern=[True, False])  # -> ListA, ListB
weave = Weave(Pattern=[1, 0], Stream0=dispatch_2.ListA, Stream1=dispatch_2.ListB, NullGaps=False)
weave_2 = Weave(Pattern=[0, 0, 1, 1], Stream0=dispatch.ListA, Stream1=weave, NullGaps=False)
polyline = PolyLine(Vertices=weave_2, Closed=False)

layer_thickness = ClusterInput()
Z = UnitZ(LayerThickness=layer_thickness)
move = Move(Geometry=polyline, Motion=Z)  # -> PrintingPath, Transform
printing_path = ClusterOutput(move.PrintingPath)
